# Grasshopper definition marker_pose_and_calibration.gh (Grasshopper 1.0.7)

# ----
# Reload Python Modules (if Module Code is Changed)
python_module_to_reload = Panel("""compas
compas_fab
roslibpy
integral_timber_joints""")
# Development Tools
reload = Button()
py = PythonScript(reload_module_button=reload, module_names=python_module_to_reload)  # inputs module_names: list
# ---------- py: Python ----------
import compas_ghpython
from compas_ghpython import unload_modules
if reload_module_button:
    for module in module_names:
        unload_modules(module)
# ---------- end py ----------

# ----
# Check Path and Environment
compas_version = GhPythonScript()  # -> out, compas_version, compas_fab_version, compas_path, compas_fab_path, compas_env_name, python_directory
# ---------- compas_version: Python ----------
__author__ = "leungp"
__version__ = "2020.04.20"

import rhinoscriptsyntax as rs
import compas
import compas_fab
compas_version  = compas.__version__
compas_fab_version = compas_fab.__version__
import os
compas_path = os.path.abspath(compas.__file__)
compas_fab_path = os.path.abspath(compas_fab.__file__)

import compas_bootstrapper
compas_env_name = compas_bootstrapper.ENVIRONMENT_NAME
python_directory = compas_bootstrapper.PYTHON_DIRECTORY
# ---------- end compas_version ----------
compas_environment_name = Panel(compas_version.compas_env_name)
compas_version_2 = Panel(compas_version.compas_version)
compas_fab_version = Panel(compas_version.compas_fab_version)
compas_path = Panel(compas_version.compas_path)
compas_fab_path = Panel(compas_version.compas_fab_path)
python_directory = Panel(compas_version.python_directory)

# ----
# Marker Calibration from ROS
panel = Panel("3. Load from ROS")
load = Button()
topic_name_with_no_slash = Panel("c1_Camera")
restart = Button()
load_2 = Button()
load_3 = Button()
topic_name_with_no_slash_2 = Panel("c3_Camera")
topic_name_with_no_slash_3 = Panel("c2_Camera")
load_4 = Button()
topic_name_with_no_slash_4 = Panel("c4_Camera")
ros = PythonScript(ip="192.168.0.120", restart=restart)  # -> out, ros_client, is_connected
# ---------- ros: Python ----------
import sys
import time
import logging
import scriptcontext as sc

from compas_fab.backends import RosClient

from System import TimeSpan
from System.Threading import ManualResetEventSlim

LOGGER = logging.getLogger('roslibpy')

key = 'rosclient_%s' % str(ghenv.Component.InstanceGuid)
previous_client = sc.sticky.get(key, None)
if previous_client:
    previous_client.terminate()

ros_client = RosClient(ip, 9090)
sc.sticky[key] = ros_client

waitLock = ManualResetEventSlim(False)

ros_client.on_ready(lambda: waitLock.Set())

if not waitLock.Wait(TimeSpan.FromSeconds(5)):
    raise Exception('Unable to connect to ROS')

LOGGER.info('ROS connection opened')


is_connected = ros_client.is_connected
# ---------- end ros ----------
is_connected = Panel(ros.is_connected)
python = PythonScript(client=ros.ros_client, load=load, ros_topic_name=topic_name_with_no_slash)  # -> robot; inputs load: Boolean
# ---------- python: Python ----------
from scriptcontext import sticky as st
import json
import compas
from compas.robots import RobotModel
from compas.geometry import Transformation
from compas_fab.backends import RosClient
from compas_fab.backends import RosFileServerLoader
from compas_fab.ghpython import RobotArtist
from roslibpy import Topic
# Set high precision to import meshes defined in meters
compas.PRECISION = '24f'

# store robot in component
topic_key = "topic_" + ros_topic_name

if ros_topic_name not in st:
    st[ros_topic_name] = None

if client and client.is_connected and load:
    st[ros_topic_name] = None
    def read_frame(msg):
        st[ros_topic_name] = Transformation.from_data(json.loads(msg['data']))
        
    topic = Topic(client, ros_topic_name, 'std_msgs/String')
    topic.subscribe(read_frame)
    st[topic_key] = topic
#
#topic = st[topic_key]
# ---------- end python ----------
python_2 = PythonScript(client=ros.ros_client, load=load_2, ros_topic_name=topic_name_with_no_slash_3)  # -> robot; inputs load: Boolean; same code as python
python_3 = PythonScript(client=ros.ros_client, load=load_3, ros_topic_name=topic_name_with_no_slash_2)  # -> robot; inputs load: Boolean; same code as python
python_4 = PythonScript(client=ros.ros_client, load=load_4, ros_topic_name=topic_name_with_no_slash_4)  # -> robot; inputs load: Boolean; same code as python
panel_2 = Panel("C:\Users\leungp\Documents\GitHub\clamp_controller\calibrations\")

# ----
# Marker Position from CAD - c1 c2 (CL3)
# Flange Frame
# Marker Frame
frame_curves_named_x_and_y = Curve([<curve referenced from the Rhino model> x3])
frame_curves_named_x_and_y_2 = Curve([<curve referenced from the Rhino model> x3])
frame_from_crv = FrameFromCrv(frame_curves_named_x_and_y=frame_curves_named_x_and_y)
frame_from_crv_2 = FrameFromCrv(frame_curves_named_x_and_y=frame_curves_named_x_and_y_2)
flange_frame = Plane(frame_from_crv)
marker_frame = Plane(frame_from_crv_2)
python_5 = GhPythonScript(flange_frame=flange_frame, marker_frame=marker_frame)  # -> out, t_flange_from_marker
# ---------- python_5: Python ----------
#from compas_ghpython import unload_modules
#unload_modules("integral_timber_joints")

from compas.geometry import Frame, Vector, Transformation
from compas_rhino.geometry import RhinoPlane, RhinoMesh, RhinoVector, RhinoLine

flange_frame = RhinoPlane.from_geometry(flange_frame).to_compas()
marker_frame = RhinoPlane.from_geometry(marker_frame).to_compas()
t_world_from_flange = Transformation.from_frame(flange_frame)
t_world_from_marker = Transformation.from_frame(marker_frame)
t_flange_from_marker = t_world_from_flange.inverse() * t_world_from_marker
print (t_flange_from_marker)
# ---------- end python_5 ----------
panel_3 = Panel(python_5.out)
# Save Calibration - c1 c2 (CL3)
panel_4 = Panel("c1_t_flange_from_marker.json")
concat = Concatenate(FragmentA=panel_2, FragmentB=[panel_4, "c2_t_flange_from_marker.json"])
python_6 = GhPythonScript(T=python_5.t_flange_from_marker, filename=concat, save=Button())  # -> out, a
# ---------- python_6: Python ----------
from compas.data import DataEncoder
import json
if save:
    with open(filename, 'w') as f:
        json.dump(T, f, cls=DataEncoder, indent=4, sort_keys=True)
# ---------- end python_6 ----------

# ----
# Marker Position from CAD - c3 c4 (CL3M)
# Flange Frame
# Marker Frame
frame_curves_named_x_and_y_3 = Curve([<curve referenced from the Rhino model> x2])
frame_curves_named_x_and_y_4 = Curve([<curve referenced from the Rhino model> x3])
frame_from_crv_3 = FrameFromCrv(frame_curves_named_x_and_y=frame_curves_named_x_and_y_3)
frame_from_crv_4 = FrameFromCrv(frame_curves_named_x_and_y=frame_curves_named_x_and_y_4)
flange_frame_2 = Plane(frame_from_crv_3)
marker_frame_2 = Plane(frame_from_crv_4)
python_7 = GhPythonScript(flange_frame=flange_frame_2, marker_frame=marker_frame_2)  # -> out, t_flange_from_marker; same code as python_5
panel_5 = Panel(python_7.out)
# Save Calibration - c3 c4 (CL3M)
panel_6 = Panel("c3_t_flange_from_marker.json")
concat_2 = Concatenate(FragmentA=panel_2, FragmentB=[panel_6, "c4_t_flange_from_marker.json"])
python_8 = GhPythonScript(T=python_7.t_flange_from_marker, filename=concat_2, save=Button())  # -> out, a; same code as python_6

flange_frame_cl3m = Plane(flange_frame_2)

topic_name = Panel("c3_Camera")
timer = Timer(TimerInterval=50, Target=python_9)
update = Button()
save = Button()
python_9 = GhPythonScript(y=update, ros_topic_name=topic_name)  # -> out, t_camera_from_marker, rhino_plane_cam_from_marker, compas_transform, compas_frame
# ---------- python_9: Python ----------
from scriptcontext import sticky as st
from compas.geometry import Frame
import Rhino.Geometry as rg

from compas_rhino.geometry import RhinoPoint
from compas_ghpython import draw_points
from compas.geometry import transform_points

print(st[ros_topic_name])

if st[ros_topic_name]:
    T = st[ros_topic_name]
    t_camera_from_marker = T
    
    
#    compas_transform = T.inverse()
#    compas_frame = Frame.from_transformation(compas_transform)
#    
#    point = list(Frame.from_transformation(compas_t_cam_from_marker).point)
#    xaxis = list(Frame.from_transformation(compas_t_cam_from_marker).xaxis)
#    yaxis = list(Frame.from_transformation(compas_t_cam_from_marker).yaxis)
#    rhino_plane_cam_from_marker = rg.Plane(rg.Point3d(*point), rg.Vector3d(*xaxis), rg.Vector3d(*yaxis))
# ---------- end python_9 ----------
panel_7 = Panel(python_9.out)

topic_name_2 = Panel("c4_Camera")
timer_2 = Timer(TimerInterval=50, Target=python_10)
update_2 = Button()
save_2 = Button()
python_10 = GhPythonScript(y=update_2, ros_topic_name=topic_name_2)  # -> out, t_camera_from_marker, rhino_plane_cam_from_marker, compas_transform, compas_frame; same code as python_9
panel_8 = Panel(python_10.out)

# ----
# Save Transforamtion
panel_9 = Panel("c3_t_camera_from_marker.json")
concat_3 = Concatenate(FragmentA=panel_2, FragmentB=panel_9)
python_11 = GhPythonScript(T=python_9.t_camera_from_marker, filename=concat_3, save=save)  # -> out, loaded_t_camera_from_marker
# ---------- python_11: Python ----------
from compas.data import DataEncoder, DataDecoder
import json
if save:
    with open(filename, 'w') as f:
        json.dump(T, f, cls=DataEncoder, indent=4, sort_keys=True)
        
import os
if os.path.exists(filename):
    with open(filename, 'r') as f:
        loaded_t_camera_from_marker = json.load(f, cls=DataDecoder)
        print(loaded_t_camera_from_marker)
# ---------- end python_11 ----------

# ----
# Save Transforamtion
panel_10 = Panel("c4_t_camera_from_marker.json")
concat_4 = Concatenate(FragmentA=panel_2, FragmentB=panel_10)
python_12 = GhPythonScript(T=python_10.t_camera_from_marker, filename=concat_4, save=save_2)  # -> out, loaded_t_camera_from_marker; same code as python_11

flange_frame_cl3 = Plane(flange_frame)
topic_name_3 = Panel("c1_Camera")
timer_3 = Timer(TimerInterval=50, Target=python_13)
update_3 = Button()
save_3 = Button()
python_13 = GhPythonScript(y=update_3, ros_topic_name=topic_name_3)  # -> out, t_camera_from_marker, rhino_plane_cam_from_marker, compas_transform, compas_frame; same code as python_9
panel_11 = Panel(python_13.out)

flange_frame_cl3_2 = Plane(flange_frame)
topic_name_4 = Panel("c2_Camera")
timer_4 = Timer(TimerInterval=50, Target=python_14)
update_4 = Button()
save_4 = Button()
python_14 = GhPythonScript(y=update_4, ros_topic_name=topic_name_4)  # -> out, t_camera_from_marker, rhino_plane_cam_from_marker, compas_transform, compas_frame; same code as python_9
panel_12 = Panel(python_14.out)

# ----
# Validate camera frame
python_15 = GhPythonScript(t_flange_from_marker=python_7.t_flange_from_marker, t_camera_from_marker=python_11.loaded_t_camera_from_marker)  # -> out, t_flange_from_camera, p_flange_from_camera
# ---------- python_15: Python ----------
from compas.geometry import Frame
import Rhino.Geometry as rg
import rhinoscriptsyntax as rs

t_flange_from_camera = t_flange_from_marker * t_camera_from_marker.inverse()
#    compas_frame = Frame.from_transformation(compas_transform)
#    
point = list(Frame.from_transformation(t_flange_from_camera).point)
xaxis = list(Frame.from_transformation(t_flange_from_camera).xaxis)
yaxis = list(Frame.from_transformation(t_flange_from_camera).yaxis)
p_flange_from_camera = rg.Plane(rg.Point3d(*point), rg.Vector3d(*xaxis), rg.Vector3d(*yaxis))
# ---------- end python_15 ----------
orient = Orient(Geometry=python_15.p_flange_from_camera, Source=PlaneXY(0, 0, 0), Target=flange_frame_cl3m)  # -> Geometry, Transform

# ----
# Correction calculation test
python_16 = GhPythonScript(
    t_flange_from_marker=python_7.t_flange_from_marker,
    t_camera_from_marker=python_11.loaded_t_camera_from_marker,
    t_camera_from_observedmarker=python_9.t_camera_from_marker)  # -> out, t_flange_from_newflange, p_flange_from_newflange
# ---------- python_16: Python ----------
from compas.geometry import Frame
import Rhino.Geometry as rg
import rhinoscriptsyntax as rs

# From CAD
t_flange_from_marker = t_flange_from_marker

# From Marker Calibration
t_camera_from_marker = t_camera_from_marker

# Observation: Observed Marker in Camera Frame
t_camera_from_observedmarker = t_camera_from_observedmarker

# Calcualtion: Camera in Flange Frame
t_flange_from_camera = t_flange_from_marker * t_camera_from_marker.inverse()

# Calculation: New Flange Frame in current flange frame 
t_observedmarker_from_newflange = t_flange_from_marker.inverse()
t_flange_from_newflange = t_flange_from_camera * t_camera_from_observedmarker * t_observedmarker_from_newflange

print(t_flange_from_newflange)

T = t_flange_from_newflange
point = list(Frame.from_transformation(T).point)
xaxis = list(Frame.from_transformation(T).xaxis)
yaxis = list(Frame.from_transformation(T).yaxis)
p_flange_from_newflange = rg.Plane(rg.Point3d(*point), rg.Vector3d(*xaxis), rg.Vector3d(*yaxis))
# ---------- end python_16 ----------
panel_13 = Panel(python_16.out)
panel_14 = Panel(python_16.p_flange_from_newflange)
orient_2 = Orient(Geometry=python_16.p_flange_from_newflange, Source=PlaneXY(0, 0, 0), Target=flange_frame_cl3m)  # -> Geometry, Transform

# ----
# Validate camera frame
python_17 = GhPythonScript(t_flange_from_marker=python_7.t_flange_from_marker, t_camera_from_marker=python_12.loaded_t_camera_from_marker)  # -> out, t_flange_from_camera, p_flange_from_camera; same code as python_15
orient_3 = Orient(Geometry=python_17.p_flange_from_camera, Source=PlaneXY(0, 0, 0), Target=flange_frame_cl3m)  # -> Geometry, Transform

# ----
# Correction calculation test
python_18 = GhPythonScript(
    t_flange_from_marker=python_7.t_flange_from_marker,
    t_camera_from_marker=python_12.loaded_t_camera_from_marker,
    t_camera_from_observedmarker=python_10.t_camera_from_marker)  # -> out, t_flange_from_newflange, p_flange_from_newflange; same code as python_16
panel_15 = Panel(python_18.out)
panel_16 = Panel(python_18.p_flange_from_newflange)
orient_4 = Orient(Geometry=python_18.p_flange_from_newflange, Source=PlaneXY(0, 0, 0), Target=flange_frame_cl3m)  # -> Geometry, Transform

# ----
# Save Transforamtion
panel_17 = Panel("c1_t_camera_from_marker.json")
concat_5 = Concatenate(FragmentA=panel_2, FragmentB=panel_17)
python_19 = GhPythonScript(T=python_13.t_camera_from_marker, filename=concat_5, save=save_3)  # -> out, loaded_t_camera_from_marker; same code as python_11

# ----
# Save Transforamtion
panel_18 = Panel("c2_t_camera_from_marker.json")
concat_6 = Concatenate(FragmentA=panel_2, FragmentB=panel_18)
python_20 = GhPythonScript(T=python_14.t_camera_from_marker, filename=concat_6, save=save_4)  # -> out, loaded_t_camera_from_marker; same code as python_11

# ----
# Validate camera frame
python_21 = GhPythonScript(t_flange_from_marker=python_5.t_flange_from_marker, t_camera_from_marker=python_19.loaded_t_camera_from_marker)  # -> out, t_flange_from_camera, p_flange_from_camera; same code as python_15
orient_5 = Orient(Geometry=python_21.p_flange_from_camera, Source=PlaneXY(0, 0, 0), Target=flange_frame_cl3)  # -> Geometry, Transform

# ----
# Correction calculation test
python_22 = GhPythonScript(
    t_flange_from_marker=python_5.t_flange_from_marker,
    t_camera_from_marker=python_19.loaded_t_camera_from_marker,
    t_camera_from_observedmarker=python_13.t_camera_from_marker)  # -> out, t_flange_from_newflange, p_flange_from_newflange; same code as python_16
panel_19 = Panel(python_22.out)
panel_20 = Panel(python_22.p_flange_from_newflange)
orient_6 = Orient(Geometry=python_22.p_flange_from_newflange, Source=PlaneXY(0, 0, 0), Target=flange_frame_cl3)  # -> Geometry, Transform

# ----
# Validate camera frame
python_23 = GhPythonScript(t_flange_from_marker=python_5.t_flange_from_marker, t_camera_from_marker=python_20.loaded_t_camera_from_marker)  # -> out, t_flange_from_camera, p_flange_from_camera; same code as python_15
orient_7 = Orient(Geometry=python_23.p_flange_from_camera, Source=PlaneXY(0, 0, 0), Target=flange_frame_cl3_2)  # -> Geometry, Transform

# ----
# Correction calculation test
python_24 = GhPythonScript(
    t_flange_from_marker=python_5.t_flange_from_marker,
    t_camera_from_marker=python_20.loaded_t_camera_from_marker,
    t_camera_from_observedmarker=python_14.t_camera_from_marker)  # -> out, t_flange_from_newflange, p_flange_from_newflange; same code as python_16
panel_21 = Panel(python_24.out)
panel_22 = Panel(python_24.p_flange_from_newflange)
orient_8 = Orient(Geometry=python_24.p_flange_from_newflange, Source=PlaneXY(0, 0, 0), Target=flange_frame_cl3_2)  # -> Geometry, Transform

# ==== cluster FrameFromCrv
frame_curves_named_x_and_y = ClusterInput()
frame_curves_named_x_and_y_2 = Curve(frame_curves_named_x_and_y)
filtername = FilterByName(Geometry=frame_curves_named_x_and_y_2, Name="y")
filtername_2 = FilterByName(Geometry=frame_curves_named_x_and_y_2, Name="x")
end = EndPoints(Curve=filtername_2)  # -> Start, End
end_2 = EndPoints(Curve=filtername)  # -> Start, End
pl_3pt = Plane3Pt(PointA=end.Start, PointB=end.End, PointC=end_2.End)
pl = ClusterOutput(pl_3pt)
