# Grasshopper definition PickAndPlace.gh (Grasshopper 1.0.7)

panel = Panel("""0.73074
0.02248
0.02379
-0.68188""")
panel_2 = Panel("""14647.32
4617.00
743.20""")

reload = Button()
python_script = PythonScript(reload=reload)  # inputs reload: Boolean
# ---------- python_script: Python ----------
from compas_rhino.utilities.misc import unload_modules

if reload:
    unload_modules('compas')
    unload_modules('compas_fab')
    unload_modules("roslibpy")
    unload_modules("compas_rrc")
# ---------- end python_script ----------

# ----
# COMPAS RRC - Robot Communication
panel_3 = Panel("192.168.0.117")
init_robot = Button()
restart = Button()
ros = PythonScript(ip=panel_3, restart=restart)  # -> ros_client, is_connected
# ---------- ros: Python ----------
import sys
import time
import logging
import scriptcontext as sc

from compas_fab.backends import RosClient

from System import TimeSpan
from System.Threading import ManualResetEventSlim

LOGGER = logging.getLogger('roslibpy')

key = 'rosclient_%s' % str(ghenv.Component.InstanceGuid)
previous_client = sc.sticky.get(key, None)
if previous_client:
    previous_client.terminate()

ros_client = RosClient(ip, 9090)
sc.sticky[key] = ros_client

waitLock = ManualResetEventSlim(False)

ros_client.on_ready(lambda: waitLock.Set())

if not waitLock.Wait(TimeSpan.FromSeconds(5)):
    raise Exception('Unable to connect to ROS')

LOGGER.info('ROS connection opened')


is_connected = ros_client.is_connected
# ---------- end ros ----------
ghpython_script = GhPythonScript(ros_client=ros.ros_client, init_robot=init_robot)  # -> robot_11, robot_12, robots; inputs init_robot: Boolean
# ---------- ghpython_script: Python ----------
from compas_rrc import *

if ros_client:
    robot_11 = AbbClient(ros_client, "/robot_1")
    robot_12 = AbbClient(ros_client, "/robot_2")
    
    robots = (robot_11, robot_12, None, None)
# ---------- end ghpython_script ----------

python = GhPythonScript(point=panel_2, quaternion=panel)  # -> out, robot_frame, preview; inputs point: list, quaternion: list
# ---------- python: Python ----------
__author__ = "leungp"
__version__ = "2020.07.13"

import rhinoscriptsyntax as rs

from compas.geometry import Frame
from compas_ghpython import draw_frame
robot_frame = Frame.from_quaternion(quaternion, point)
preview = draw_frame(robot_frame)
# ---------- end python ----------
pln_gripper_storage = Plane(Plane(origin=(15143.33511, 6577.085731, 716.6403627), x=(-0.9999735, 0.001217146491, 0.007177598739), y=(0.001202603462, 0.9999972161, -0.00203013715)))
pln_robot = Plane(python.preview)
pln_gripper_on_robot = Plane(Plane(origin=(14574.71476, 4667.567393, 910.8187632), x=(-0.07970579298, 0.994791032, 0.06354360169), y=(-0.9968160618, -0.07940447635, -0.007257279732)))

pln_clamp_on_robot = Plane(Plane(origin=(14721.30288, 4527.612298, 1174.656089), x=(-0.0008523588385, 0.05544149289, -0.9984615738), y=(0.07883241299, -0.9953508783, -0.0553360626)))
pln_clamp_onbeam = Plane(Plane(origin=(15494.14536, 4332.686339, 1502.652901), x=(-0.9995835078, -0.02833524151, -0.005470375807), y=(0.006339107888, -0.03066053716, -0.9995097534)))
# Doubleclick Me!
clamp_storage = Plane(Plane(origin=(15137.95381, 7132.686907, 338.3007638), x=(0.002010530122, -0.01039253879, 0.9999439749), y=(-0.006428653517, -0.9999254672, -0.01037942072)))

send = Button()

ghpython_script_2 = GhPythonScript(get_robot_frame=Button(), robot=ghpython_script.robot_11)  # -> plane; inputs get_robot_frame: Boolean
# ---------- ghpython_script_2: Python ----------
from scriptcontext import sticky as st
from compas_rrc import *
from compas_ghpython import draw_frame



# output sticky
guid = str(ghenv.Component.InstanceGuid)
response_key_frame = "robot_frame_" + guid
if response_key_frame not in st:
    st[response_key_frame] = None



if get_robot_frame:
    
    
    # get current robot pose
    robot.send(SetWorkObject('wobj0'))
    robot.send(SetTool('tool0'))
    
    #robot.send(SetWorkObject('wobj0'))
    #robot.send(SetTool('tool0'))
    
    robot_current_robtarget = robot.send_and_wait(GetRobtarget(), timeout=10)

    robot_current_frame = robot_current_robtarget[0]
    robot_current_external_exes = robot_current_robtarget[1]
    
    st[response_key_frame] = robot_current_frame



plane = draw_frame(st[response_key_frame])
# ---------- end ghpython_script_2 ----------
data = Data(ghpython_script_2)

orient = Orient(Geometry=pln_robot, Source=pln_clamp_on_robot, Target=pln_clamp_onbeam)  # -> Geometry, Transform
orient_2 = Orient(Geometry=pln_robot, Source=pln_gripper_on_robot, Target=pln_gripper_storage)  # -> Geometry, Transform
orient_3 = Orient(Geometry=pln_robot, Source=pln_clamp_on_robot, Target=clamp_storage)  # -> Geometry, Transform
pickup_offset_z = Slider(0, range=0..500)
pickup_offset_z_2 = Slider(1, range=0..500)
pickup_offset_z_3 = Slider(500, range=0..500)
pickup_offset_y = Slider(10, range=0..500)
pln_robot_at_clamp_storage = Plane(orient_2.Geometry)
pln_robot_at_clamp_storage_2 = Plane(orient_3.Geometry)
Z = UnitZ(Factor=pickup_offset_z_2)
Z_2 = UnitZ(Factor=pickup_offset_z_3)
pln_robot_at_clamp_storage_3 = Plane(orient.Geometry)
neg = Negative(Value=pickup_offset_z)
neg_2 = Negative(Value=pickup_offset_y)
panel_4 = Panel(data)
move = Move(Geometry=orient_2.Geometry, Motion=Z)  # -> Geometry, Transform
move_2 = Move(Geometry=orient_3.Geometry, Motion=Z_2)  # -> Geometry, Transform
Y = UnitY(Factor=neg_2)
X = UnitX(Factor=neg)
pln_robot_at_clamp_storage_pickup = Plane(move.Geometry)
ghpython_script_3 = GhPythonScript(send=send, robot=ghpython_script.robot_11, target_plane=pln_robot_at_clamp_storage_pickup)  # -> out; inputs send: Boolean
# ---------- ghpython_script_3: Python ----------
import compas.geometry as cg
from compas_rrc import *
from compas_ghpython import draw_frame

from compas_rhino.geometry import RhinoPlane
target_frame = RhinoPlane.from_geometry(target_plane).to_compas()

if send:
    
    
    
    # send correction
    robot.send(SetWorkObject('wobj0'))
    robot.send(SetTool('tool0'))
    
    
    robot_current_robtarget = robot.send_and_wait(GetRobtarget(), timeout=1)
    robot_current_external_exes = robot_current_robtarget[1]
    
    
    speed = 50 #mm/s
    zone = Zone.FINE

#    robot.send_and_wait(MoveToRobtarget(target_frame, robot_current_external_exes, speed, zone, motion_type=Motion.LINEAR), timeout=1)
    robot.send(MoveToRobtarget(target_frame, robot_current_external_exes, speed, zone, motion_type=Motion.LINEAR))
# ---------- end ghpython_script_3 ----------
rec = DataRecorder(ghpython_script_3, DataLimit=-10, RecordData=True)
panel_5 = Panel(rec)
pln_robot_at_clamp_storage_pickup_2 = Plane(move_2.Geometry)
addition = Addition(A=X, B=Y)
move_3 = Move(Geometry=orient.Geometry, Motion=addition)  # -> Geometry, Transform
pln_robot_at_clamp_storage_pickup_3 = Plane(move_3.Geometry)
