# Grasshopper definition ProbedPoints.gh (Grasshopper 1.0.7)

panel = Panel("""0.73074
0.02248
0.02379
-0.68188""")
panel_2 = Panel("""14647.32
4617.00
743.20""")
python = GhPythonScript(point=panel_2, quaternion=panel)  # -> out, robot_frame, preview; inputs point: list, quaternion: list
# ---------- python: Python ----------
__author__ = "leungp"
__version__ = "2020.07.13"

import rhinoscriptsyntax as rs

from compas.geometry import Frame
from compas_ghpython import draw_frame
robot_frame = Frame.from_quaternion(quaternion, point)
preview = draw_frame(robot_frame)
# ---------- end python ----------
pln_clamp_on_robot = Plane(Plane(origin=(14721.30288, 4527.612298, 1174.656089), x=(-0.0008523588385, 0.05544149289, -0.9984615738), y=(0.07883241299, -0.9953508783, -0.0553360626)))
pln_gripper_storage = Plane(Plane(origin=(15142.36784, 6577.274601, 716.5684927), x=(0.9999804977, -0.001735768173, -0.005999271482), y=(-0.001723329974, -0.9999963564, 0.002077832866)))
pln_gripper_storage_2 = Plane(Plane(origin=(14574.10153, 4666.761066, 910.9802249), x=(0.08004599315, -0.9947581604, -0.06363050658), y=(0.9967907805, 0.07993922243, 0.004226182648)))
pln_clamp_onbeam = Plane(Plane(origin=(15494.14536, 4332.686339, 1502.652901), x=(-0.9995835078, -0.02833524151, -0.005470375807), y=(0.006339107888, -0.03066053716, -0.9995097534)))
clamp_storage = Plane(Plane(origin=(15137.95381, 7132.686907, 338.3007638), x=(0.002010530122, -0.01039253879, 0.9999439749), y=(-0.006428653517, -0.9999254672, -0.01037942072)))
# Main Plane
# clamp_on_robot
# X Plane
pt = Point([<point referenced from the Rhino model> x5])
# Y Plane
pt_2 = Point([<point referenced from the Rhino model> x10])
pt_3 = Point([<point referenced from the Rhino model> x6])
# Main Plane
# gripper_on_robot
# X Plane
pt_4 = Point([<point referenced from the Rhino model> x7])
# Y Plane
pt_5 = Point([<point referenced from the Rhino model> x7])
pt_6 = Point([<point referenced from the Rhino model> x7])
# Main Plane
# clamp_storage
# X Plane
pt_7 = Point([<point referenced from the Rhino model> x8])
# Y Plane
pt_8 = Point([<point referenced from the Rhino model> x6])
pt_9 = Point([<point referenced from the Rhino model> x8])
# Main Plane
# clamp_onbeam
# X Plane
pt_10 = Point([<point referenced from the Rhino model> x6])
# Y Plane
pt_11 = Point([<point referenced from the Rhino model> x5])
pt_12 = Point([<point referenced from the Rhino model> x11])
# Main Plane
# gripper_storage
# X Plane
pt_13 = Point([<point referenced from the Rhino model> x5])
# Y Plane
pt_14 = Point([<point referenced from the Rhino model> x5])
pt_15 = Point([<point referenced from the Rhino model> x7])
plfit = PlaneFit(Points=pt_7)  # -> Plane, Deviation
plfit_2 = PlaneFit(Points=pt_8)  # -> Plane, Deviation
plfit_3 = PlaneFit(Points=pt)  # -> Plane, Deviation
plfit_4 = PlaneFit(Points=pt_9)  # -> Plane, Deviation
plfit_5 = PlaneFit(Points=pt_2)  # -> Plane, Deviation
plfit_6 = PlaneFit(Points=pt_3)  # -> Plane, Deviation
plfit_7 = PlaneFit(Points=pt_4)  # -> Plane, Deviation
plfit_8 = PlaneFit(Points=pt_5)  # -> Plane, Deviation
plfit_9 = PlaneFit(Points=pt_6)  # -> Plane, Deviation
plfit_10 = PlaneFit(Points=pt_10)  # -> Plane, Deviation
plfit_11 = PlaneFit(Points=pt_11)  # -> Plane, Deviation
merge = Merge(Data1=pt_7, Data2=pt_8, Data3=pt_9)
plfit_12 = PlaneFit(Points=pt_12)  # -> Plane, Deviation
merge_2 = Merge(Data1=pt_10, Data2=pt_11, Data3=pt_12)
plfit_13 = PlaneFit(Points=pt_13)  # -> Plane, Deviation
plfit_14 = PlaneFit(Points=pt_14)  # -> Plane, Deviation
plfit_15 = PlaneFit(Points=pt_15)  # -> Plane, Deviation
panel_3 = Panel(plfit_3.Deviation)
cp = PlaneClosestPoint(Point=pt_6, Plane=plfit_9.Plane)  # -> Point, UVPoint, Distance
merge_3 = Merge(Data1=pt_4, Data2=pt_5, Data3=pt_6)
ppx = PlanePlane(PlaneA=plfit_2.Plane, PlaneB=plfit_4.Plane)
panel_4 = Panel(plfit_10.Deviation)
ppx_2 = PlanePlane(PlaneA=plfit_5.Plane, PlaneB=plfit_6.Plane)
panel_5 = Panel(plfit_7.Deviation)
panel_6 = Panel(plfit_13.Deviation)
ppx_3 = PlanePlane(PlaneA=plfit_8.Plane, PlaneB=plfit_9.Plane)
ppx_4 = PlanePlane(PlaneA=plfit_11.Plane, PlaneB=plfit_12.Plane)
ppx_5 = PlanePlane(PlaneA=plfit_14.Plane, PlaneB=plfit_15.Plane)
panel_7 = Panel(plfit_5.Deviation)
ln = Line(StartPoint=pt_6, EndPoint=cp.Point)
merge_4 = Merge(Data1=pt_13, Data2=pt_14, Data3=pt_15)
panel_8 = Panel(plfit_11.Deviation)
panel_9 = Panel(plfit_8.Deviation)
panel_10 = Panel(plfit_14.Deviation)
ppx_6 = PlanePlane(PlaneA=plfit.Plane, PlaneB=plfit_2.Plane)
ppx_7 = PlanePlane(PlaneA=plfit.Plane, PlaneB=plfit_4.Plane)
ppx_8 = PlanePlane(PlaneA=plfit_3.Plane, PlaneB=plfit_5.Plane)
ppx_9 = PlanePlane(PlaneA=plfit_3.Plane, PlaneB=plfit_6.Plane)
plx = LinePlane(Line=ppx, Plane=plfit.Plane)  # -> Point, ParamL, ParamP
plx_2 = LinePlane(Line=ppx_2, Plane=plfit_3.Plane)  # -> Point, ParamL, ParamP

# ----
# gripper_on_robot
number_slider = Slider(0.58354, range=-5..5)
number_slider_2 = Slider(1.1861, range=-5..5)
number_slider_3 = Slider(-0.13717, range=-5..5)
number_slider_4 = Slider(0.00055, range=-0.05..0.05)
number_slider_5 = Slider(0.00101, range=-0.05..0.05)
number_slider_6 = Slider(5e-05, range=-0.05..0.05)
# 2020 07 01 New Method of Fitting Frame to probed points. Using Estmate and Galapagos
xy_plane_pts = Point([<point referenced from the Rhino model> x7])
xz_plane_pts = Point([<point referenced from the Rhino model> x7])
yz_plane_pts = Point([<point referenced from the Rhino model> x7])
fitting_frame = FittingFrame(
    pt=xy_plane_pts,
    pt_2=xz_plane_pts,
    pt_3=yz_plane_pts,
    F_3=number_slider,
    F_2=number_slider_2,
    F=number_slider_3,
    N=number_slider_4,
    N_2=number_slider_5,
    N_3=number_slider_6)  # -> lsq_fitness, D, D_2, D_3, pln_2
abs = Absolute(Value=[fitting_frame.D, fitting_frame.D_2, fitting_frame.D_3])
fitness = Panel(fitting_frame.lsq_fitness)
pln_gripper_on_robot = Plane(fitting_frame.pln_2)
galapagos = Galapagos(
    fitness=fitting_frame,
    gene=[number_slider, number_slider_2, number_slider_3, number_slider_4, number_slider_5, number_slider_6])
sort = SortList(Keys=abs)  # -> reverse(Keys), ValuesA
error_distance = Panel(sort.Keys)

ppx_10 = PlanePlane(PlaneA=plfit_7.Plane, PlaneB=plfit_8.Plane)
ppx_11 = PlanePlane(PlaneA=plfit_7.Plane, PlaneB=plfit_9.Plane)
ppx_12 = PlanePlane(PlaneA=plfit_10.Plane, PlaneB=plfit_11.Plane)
plx_3 = LinePlane(Line=ppx_3, Plane=plfit_7.Plane)  # -> Point, ParamL, ParamP
ppx_13 = PlanePlane(PlaneA=plfit_10.Plane, PlaneB=plfit_12.Plane)

# ----
# Main Plane
# gripper_storage
# X Plane
# Y Plane
pt_16 = Point([<point referenced from the Rhino model> x5])
pt_17 = Point([<point referenced from the Rhino model> x5])
pt_18 = Point([<point referenced from the Rhino model> x7])
number_slider_7 = Slider(0.96727, range=-5..5)
number_slider_8 = Slider(0.07187, range=-5..5)
number_slider_9 = Slider(0.0376, range=-0.05..0.05)
number_slider_10 = Slider(-0.03755, range=-0.05..0.05)
number_slider_11 = Slider(0.00169, range=-0.05..0.05)
number_slider_12 = Slider(-0.18887, range=-5..5)
multiplication = Multiplication(A=number_slider_9, B="0.01")
multiplication_2 = Multiplication(A=number_slider_10, B="0.01")
multiplication_3 = Multiplication(A=number_slider_11, B="0.01")
cluster = FittingFrame(
    pt=pt_16,
    pt_2=pt_17,
    pt_3=pt_18,
    F_3=number_slider_7,
    F_2=number_slider_12,
    F=number_slider_8,
    N=multiplication,
    N_2=multiplication_2,
    N_3=multiplication_3)  # -> lsq_fitness, D, D_2, D_3, pln_2
galapagos_2 = Galapagos(gene=[number_slider_7, number_slider_12, number_slider_8, number_slider_9, number_slider_11, number_slider_10])
pln_gripper_storage_3 = Plane(cluster.pln_2)
fitness_2 = Panel(cluster.lsq_fitness)
abs_2 = Absolute(Value=[cluster.D, cluster.D_2, cluster.D_3])
sort_2 = SortList(Keys=abs_2)  # -> reverse(Keys), ValuesA
error_distance_2 = Panel(sort_2.Keys)

panel_11 = Panel(plfit_6.Deviation)
plx_4 = LinePlane(Line=ppx_4, Plane=plfit_10.Plane)  # -> Point, ParamL, ParamP
tag = TextTag3D(Location=cp.Point, Text=cp.Distance, Size=1, Justification=7)
panel_12 = Panel(plfit_12.Deviation)
ppx_14 = PlanePlane(PlaneA=plfit_13.Plane, PlaneB=plfit_14.Plane)
ppx_15 = PlanePlane(PlaneA=plfit_13.Plane, PlaneB=plfit_15.Plane)
panel_13 = Panel(plfit_9.Deviation)
panel_14 = Panel(plfit_15.Deviation)
plx_5 = LinePlane(Line=ppx_5, Plane=plfit_13.Plane)  # -> Point, ParamL, ParamP
project = Project(Geometry=ppx_6, Plane=plfit.Plane)  # -> Geometry, Transform
project_2 = Project(Geometry=ppx_7, Plane=plfit.Plane)  # -> Geometry, Transform
project_3 = Project(Geometry=ppx_8, Plane=plfit_3.Plane)  # -> Geometry, Transform
project_4 = Project(Geometry=ppx_9, Plane=plfit_3.Plane)  # -> Geometry, Transform
project_5 = Project(Geometry=ppx_10, Plane=plfit_7.Plane)  # -> Geometry, Transform
project_6 = Project(Geometry=ppx_11, Plane=plfit_7.Plane)  # -> Geometry, Transform
pt_origin = Point(plx.Point)
pt_origin_2 = Point(plx_2.Point)
project_7 = Project(Geometry=ppx_12, Plane=plfit_10.Plane)  # -> Geometry, Transform
project_8 = Project(Geometry=ppx_13, Plane=plfit_10.Plane)  # -> Geometry, Transform
pt_origin_3 = Point(plx_3.Point)
pt_origin_4 = Point(plx_4.Point)
project_9 = Project(Geometry=ppx_14, Plane=plfit_13.Plane)  # -> Geometry, Transform
project_10 = Project(Geometry=ppx_15, Plane=plfit_13.Plane)  # -> Geometry, Transform
pt_origin_5 = Point(plx_5.Point)
end = EndPoints(Curve=project.Geometry)  # -> Start, End
end_2 = EndPoints(Curve=project_2.Geometry)  # -> Start, End
end_3 = EndPoints(Curve=project_3.Geometry)  # -> Start, End
end_4 = EndPoints(Curve=project_4.Geometry)  # -> Start, End
end_5 = EndPoints(Curve=project_5.Geometry)  # -> Start, End
end_6 = EndPoints(Curve=project_6.Geometry)  # -> Start, End
end_7 = EndPoints(Curve=project_7.Geometry)  # -> Start, End
end_8 = EndPoints(Curve=project_8.Geometry)  # -> Start, End
end_9 = EndPoints(Curve=project_9.Geometry)  # -> Start, End
end_10 = EndPoints(Curve=project_10.Geometry)  # -> Start, End
vec2pt = Vector2Pt(PointA=end_2.Start, PointB=end_2.End, Unitize=False)  # -> Vector, Length
vec2pt_2 = Vector2Pt(PointA=end.Start, PointB=end.End, Unitize=False)  # -> Vector, Length
vec2pt_3 = Vector2Pt(PointA=end_4.Start, PointB=end_4.End, Unitize=False)  # -> Vector, Length
vec2pt_4 = Vector2Pt(PointA=end_3.Start, PointB=end_3.End, Unitize=False)  # -> Vector, Length
vec2pt_5 = Vector2Pt(PointA=end_6.Start, PointB=end_6.End, Unitize=False)  # -> Vector, Length
vec2pt_6 = Vector2Pt(PointA=end_5.Start, PointB=end_5.End, Unitize=False)  # -> Vector, Length
vec2pt_7 = Vector2Pt(PointA=end_8.Start, PointB=end_8.End, Unitize=False)  # -> Vector, Length
vec2pt_8 = Vector2Pt(PointA=end_7.Start, PointB=end_7.End, Unitize=False)  # -> Vector, Length
vec2pt_9 = Vector2Pt(PointA=end_10.Start, PointB=end_10.End, Unitize=False)  # -> Vector, Length
vec2pt_10 = Vector2Pt(PointA=end_9.Start, PointB=end_9.End, Unitize=False)  # -> Vector, Length

# ----
# Average out the non 90deg
angle = Angle(VectorA=vec2pt_2.Vector, VectorB=vec2pt.Vector)  # -> Angle, Reflex
deg = Degrees(Radians=angle.Angle)
panel_15 = Panel(deg)

# ----
# Average out the non 90deg
angle_2 = Angle(VectorA=vec2pt_4.Vector, VectorB=vec2pt_3.Vector)  # -> Angle, Reflex
deg_2 = Degrees(Radians=angle_2.Angle)
panel_16 = Panel(deg_2)

# ----
# Average out the non 90deg
angle_3 = Angle(VectorA=vec2pt_6.Vector, VectorB=vec2pt_5.Vector)  # -> Angle, Reflex
deg_3 = Degrees(Radians=angle_3.Angle)
panel_17 = Panel(deg_3)

# ----
# Average out the non 90deg
angle_4 = Angle(VectorA=vec2pt_8.Vector, VectorB=vec2pt_7.Vector)  # -> Angle, Reflex
deg_4 = Degrees(Radians=angle_4.Angle)
panel_18 = Panel(deg_4)

flip_x = BooleanToggle(True)
flip_y = BooleanToggle(False)
flip_x_2 = BooleanToggle(False)
flip_y_2 = BooleanToggle(False)

# ----
# Average out the non 90deg
angle_5 = Angle(VectorA=vec2pt_10.Vector, VectorB=vec2pt_9.Vector)  # -> Angle, Reflex
deg_5 = Degrees(Radians=angle_5.Angle)
panel_19 = Panel(deg_5)

flip_x_3 = BooleanToggle(True)
flip_y_3 = BooleanToggle(True)
flip_x_4 = BooleanToggle(False)
flip_y_4 = BooleanToggle(True)
flip_x_5 = BooleanToggle(True)
flip_y_5 = BooleanToggle(False)
bool = Boolean(Toggle(True))
bool_2 = Boolean(flip_x)
bool_3 = Boolean(flip_y)
bool_4 = Boolean(Toggle(True))
bool_5 = Boolean(flip_x_2)
bool_6 = Boolean(flip_y_2)
bool_7 = Boolean(Toggle(False))
bool_8 = Boolean(flip_x_3)
bool_9 = Boolean(flip_y_3)
bool_10 = Boolean(Toggle(True))
bool_11 = Boolean(flip_x_4)
bool_12 = Boolean(flip_y_4)
bool_13 = Boolean(Toggle(False))
bool_14 = Boolean(flip_x_5)
bool_15 = Boolean(flip_y_5)
flip_plane = FlipPlane(P=pln_gripper_storage_3, flip_x=Toggle(False), flip_y=Toggle(True))
pln_gripper_storage_4 = Plane(flip_plane)
orient = Orient(Geometry=[xy_plane_pts, xz_plane_pts, yz_plane_pts], Source=pln_gripper_on_robot, Target=pln_gripper_storage_4)  # -> Geometry, Transform

# ----
# Average out the non 90deg
pi = Pi(Factor=0.5)
subtraction = Subtraction(A=angle.Angle, B=pi)
division = Division(A=subtraction, B=2)
neg = Negative(Value=division)

filter = StreamFilter(Gate=bool, Stream0=neg, Stream1=division)
filter_2 = StreamFilter(Gate=bool, Stream0=division, Stream1=neg)

rotate = Rotate(Geometry=vec2pt_2.Vector, Angle=filter, Plane=plfit.Plane)  # -> Geometry, Transform
rotate_2 = Rotate(Geometry=vec2pt.Vector, Angle=filter_2, Plane=plfit.Plane)  # -> Geometry, Transform

rev = Reverse(Vector=rotate.Geometry)
rev_2 = Reverse(Vector=rotate_2.Geometry)
filter_3 = StreamFilter(Gate=bool_2, Stream0=rotate.Geometry, Stream1=rev)
filter_4 = StreamFilter(Gate=bool_3, Stream0=rotate_2.Geometry, Stream1=rev_2)
pl = ConstructPlane(Origin=pt_origin, XAxis=filter_3, YAxis=filter_4)
pln = Plane(pl)
pln_2 = Plane(pl)

angle_6 = Angle(VectorA=rotate.Geometry, VectorB=rotate_2.Geometry)  # -> Angle, Reflex
deg_6 = Degrees(Radians=angle_6.Angle)
panel_20 = Panel(deg_6)

# ----
# Average out the non 90deg
pi_2 = Pi(Factor=0.5)
subtraction_2 = Subtraction(A=angle_2.Angle, B=pi_2)
division_2 = Division(A=subtraction_2, B=2)
neg_2 = Negative(Value=division_2)

filter_5 = StreamFilter(Gate=bool_4, Stream0=neg_2, Stream1=division_2)
filter_6 = StreamFilter(Gate=bool_4, Stream0=division_2, Stream1=neg_2)

rotate_3 = Rotate(Geometry=vec2pt_4.Vector, Angle=filter_5, Plane=plfit_3.Plane)  # -> Geometry, Transform
rotate_4 = Rotate(Geometry=vec2pt_3.Vector, Angle=filter_6, Plane=plfit_3.Plane)  # -> Geometry, Transform

rev_3 = Reverse(Vector=rotate_3.Geometry)
rev_4 = Reverse(Vector=rotate_4.Geometry)
filter_7 = StreamFilter(Gate=bool_5, Stream0=rotate_3.Geometry, Stream1=rev_3)
filter_8 = StreamFilter(Gate=bool_6, Stream0=rotate_4.Geometry, Stream1=rev_4)
pl_2 = ConstructPlane(Origin=pt_origin_2, XAxis=filter_7, YAxis=filter_8)
pln_3 = Plane(pl_2)
pln_4 = Plane(pl_2)
orient_2 = Orient(Geometry=merge, Source=pln_2, Target=pln_4)  # -> Geometry, Transform

angle_7 = Angle(VectorA=rotate_3.Geometry, VectorB=rotate_4.Geometry)  # -> Angle, Reflex
deg_7 = Degrees(Radians=angle_7.Angle)
panel_21 = Panel(deg_7)

# ----
# Average out the non 90deg
pi_3 = Pi(Factor=0.5)
subtraction_3 = Subtraction(A=angle_3.Angle, B=pi_3)
division_3 = Division(A=subtraction_3, B=2)
neg_3 = Negative(Value=division_3)

filter_9 = StreamFilter(Gate=bool_7, Stream0=neg_3, Stream1=division_3)
filter_10 = StreamFilter(Gate=bool_7, Stream0=division_3, Stream1=neg_3)

rotate_5 = Rotate(Geometry=vec2pt_6.Vector, Angle=filter_9, Plane=plfit_7.Plane)  # -> Geometry, Transform
rotate_6 = Rotate(Geometry=vec2pt_5.Vector, Angle=filter_10, Plane=plfit_7.Plane)  # -> Geometry, Transform

rev_5 = Reverse(Vector=rotate_5.Geometry)
rev_6 = Reverse(Vector=rotate_6.Geometry)
filter_11 = StreamFilter(Gate=bool_8, Stream0=rotate_5.Geometry, Stream1=rev_5)
filter_12 = StreamFilter(Gate=bool_9, Stream0=rotate_6.Geometry, Stream1=rev_6)
pl_3 = ConstructPlane(Origin=pt_origin_3, XAxis=filter_11, YAxis=filter_12)
pln_5 = Plane(pl_3)

angle_8 = Angle(VectorA=rotate_5.Geometry, VectorB=rotate_6.Geometry)  # -> Angle, Reflex
deg_8 = Degrees(Radians=angle_8.Angle)
panel_22 = Panel(deg_8)

# ----
# Average out the non 90deg
pi_4 = Pi(Factor=0.5)
subtraction_4 = Subtraction(A=angle_4.Angle, B=pi_4)
division_4 = Division(A=subtraction_4, B=2)
neg_4 = Negative(Value=division_4)

filter_13 = StreamFilter(Gate=bool_10, Stream0=neg_4, Stream1=division_4)
filter_14 = StreamFilter(Gate=bool_10, Stream0=division_4, Stream1=neg_4)

rotate_7 = Rotate(Geometry=vec2pt_8.Vector, Angle=filter_13, Plane=plfit_10.Plane)  # -> Geometry, Transform
rotate_8 = Rotate(Geometry=vec2pt_7.Vector, Angle=filter_14, Plane=plfit_10.Plane)  # -> Geometry, Transform

rev_7 = Reverse(Vector=rotate_7.Geometry)
rev_8 = Reverse(Vector=rotate_8.Geometry)
filter_15 = StreamFilter(Gate=bool_11, Stream0=rotate_7.Geometry, Stream1=rev_7)
filter_16 = StreamFilter(Gate=bool_12, Stream0=rotate_8.Geometry, Stream1=rev_8)
pl_4 = ConstructPlane(Origin=pt_origin_4, XAxis=filter_15, YAxis=filter_16)
pln_6 = Plane(pl_4)
pln_7 = Plane(pl_4)
orient_3 = Orient(Geometry=merge_2, Source=pln_7, Target=pln_4)  # -> Geometry, Transform

angle_9 = Angle(VectorA=rotate_7.Geometry, VectorB=rotate_8.Geometry)  # -> Angle, Reflex
deg_9 = Degrees(Radians=angle_9.Angle)
panel_23 = Panel(deg_9)

# ----
# Average out the non 90deg
pi_5 = Pi(Factor=0.5)
subtraction_5 = Subtraction(A=angle_5.Angle, B=pi_5)
division_5 = Division(A=subtraction_5, B=2)
neg_5 = Negative(Value=division_5)

filter_17 = StreamFilter(Gate=bool_13, Stream0=neg_5, Stream1=division_5)
filter_18 = StreamFilter(Gate=bool_13, Stream0=division_5, Stream1=neg_5)

rotate_9 = Rotate(Geometry=vec2pt_10.Vector, Angle=filter_17, Plane=plfit_13.Plane)  # -> Geometry, Transform
rotate_10 = Rotate(Geometry=vec2pt_9.Vector, Angle=filter_18, Plane=plfit_13.Plane)  # -> Geometry, Transform

rev_9 = Reverse(Vector=rotate_9.Geometry)
rev_10 = Reverse(Vector=rotate_10.Geometry)
filter_19 = StreamFilter(Gate=bool_14, Stream0=rotate_9.Geometry, Stream1=rev_9)
filter_20 = StreamFilter(Gate=bool_15, Stream0=rotate_10.Geometry, Stream1=rev_10)
pl_5 = ConstructPlane(Origin=pt_origin_5, XAxis=filter_19, YAxis=filter_20)
pln_8 = Plane(pl_5)
orient_4 = Orient(Geometry=merge_4, Source=pln_8, Target=pln_5)  # -> Geometry, Transform

angle_10 = Angle(VectorA=rotate_9.Geometry, VectorB=rotate_10.Geometry)  # -> Angle, Reflex
deg_10 = Degrees(Radians=angle_10.Angle)
panel_24 = Panel(deg_10)

# ==== cluster FittingFrame
pt = ClusterInput()
pt_2 = ClusterInput()
pt_3 = ClusterInput()
F = ClusterInput()
F_2 = ClusterInput()
F_3 = ClusterInput()
N = ClusterInput()
N_2 = ClusterInput()
N_3 = ClusterInput()
pt_4 = Point(pt)
pt_5 = Point(pt_2)
pt_6 = Point(pt_3)
pi = Pi(Factor=N)
pi_2 = Pi(Factor=N_2)
pi_3 = Pi(Factor=N_3)

# ----
# Plane Fit Estimate
plfit = PlaneFit(Points=pt_4)  # -> Plane, Deviation
plfit_2 = PlaneFit(Points=pt_5)  # -> Plane, Deviation
plfit_3 = PlaneFit(Points=pt_6)  # -> Plane, Deviation
_3px = PlanePlanePlane(PlaneA=plfit.Plane, PlaneB=plfit_2.Plane, PlaneC=plfit_3.Plane)  # -> Point, LineAB, LineAC, LineBC
pl = ConstructPlane(Origin=_3px.Point, XAxis=_3px.LineAB, YAxis=_3px.LineAC)

# ----
# Transformation
Z = UnitZ(Factor=F)
Y = UnitY(Factor=F_2)
X = UnitX(Factor=F_3)
addition = Addition(A=X, B=Y, C=Z)
move = Move(Geometry=pl, Motion=addition)  # -> Geometry, Transform
xy = XYPlane(Origin=move.Geometry)
xz = XZPlane(Origin=move.Geometry)
yz = YZPlane(Origin=move.Geometry)
rotate = Rotate(Geometry=move.Geometry, Angle=pi, Plane=xy)  # -> Geometry, Transform
rotate_2 = Rotate(Geometry=rotate.Geometry, Angle=pi_2, Plane=xz)  # -> Geometry, Transform
rotate_3 = Rotate(Geometry=rotate_2.Geometry, Angle=pi_3, Plane=yz)  # -> Geometry, Transform

# ----
# Evaluate by least square projection distance.
pln = Plane(rotate_3.Geometry)
deplane = DeconstructPlane(Plane=pln)  # -> Origin, XAxis, YAxis, ZAxis
pl_2 = ConstructPlane(Origin=deplane.Origin, XAxis=deplane.XAxis, YAxis=deplane.YAxis)
pl_3 = ConstructPlane(Origin=deplane.Origin, XAxis=deplane.XAxis, YAxis=deplane.ZAxis)
pl_4 = ConstructPlane(Origin=deplane.Origin, XAxis=deplane.YAxis, YAxis=deplane.ZAxis)
cp = PlaneClosestPoint(Point=pt_4, Plane=pl_2)  # -> Point, UVPoint, Distance
cp_2 = PlaneClosestPoint(Point=pt_5, Plane=pl_3)  # -> Point, UVPoint, Distance
cp_3 = PlaneClosestPoint(Point=pt_6, Plane=pl_4)  # -> Point, UVPoint, Distance
sqr = Square(Value=cp.Distance)
sqr_2 = Square(Value=cp_3.Distance)
sqr_3 = Square(Value=cp_2.Distance)
ma = MassAddition(Input=[sqr, sqr_2, sqr_3])  # -> Result, PartialResults

lsq_fitness = ClusterOutput(ma.Result)
D = ClusterOutput(cp.Distance)
D_2 = ClusterOutput(cp_2.Distance)
D_3 = ClusterOutput(cp_3.Distance)
pln_2 = ClusterOutput(pln)

# ==== cluster FlipPlane
P = ClusterInput()
flip_x = ClusterInput()
flip_y = ClusterInput()
deplane = DeconstructPlane(Plane=P)  # -> Origin, XAxis, YAxis, ZAxis
flip_x_2 = Boolean(flip_x)
flip_y_2 = Boolean(flip_y)
rev = Reverse(Vector=deplane.XAxis)
rev_2 = Reverse(Vector=deplane.YAxis)
filter = StreamFilter(Gate=flip_x_2, Stream0=deplane.XAxis, Stream1=rev)
filter_2 = StreamFilter(Gate=flip_y_2, Stream0=deplane.YAxis, Stream1=rev_2)
pl = ConstructPlane(Origin=deplane.Origin, XAxis=filter, YAxis=filter_2)
pl_2 = ClusterOutput(pl)
