# Grasshopper definition ProbedPointsConverter_4.gh (Grasshopper 1.0.7)
# plug-ins: Kangaroo Components

xy_plane_pts = Point([<point referenced from the Rhino model> x51])
xz_plane_pts = Point([<point referenced from the Rhino model> x71])
# gripper_on_robot
yz_plane_pts = Point([<point referenced from the Rhino model> x84])

pt = Point([<point referenced from the Rhino model> x5])
pt_2 = Point([<point referenced from the Rhino model> x5])
pt_3 = Point([<point referenced from the Rhino model> x7])

# ----
# Remove dup pts
number_slider = Slider(0.001, range=0..0.001)
# 2020 07 01 New Method of Fitting Frame to probed points. Using Estmate and Galapagos
duppt = RemoveDuplicatePts(Points=xy_plane_pts, Tolerance=number_slider)
duppt_2 = RemoveDuplicatePts(Points=xz_plane_pts, Tolerance=number_slider)
duppt_3 = RemoveDuplicatePts(Points=yz_plane_pts, Tolerance=number_slider)

# ----
# Remove dup pts
number_slider_2 = Slider(0.001, range=0..0.001)
duppt_4 = RemoveDuplicatePts(Points=pt, Tolerance=number_slider_2)
duppt_5 = RemoveDuplicatePts(Points=pt_2, Tolerance=number_slider_2)
duppt_6 = RemoveDuplicatePts(Points=pt_3, Tolerance=number_slider_2)

probed_points_4 = Panel("""15:17:09	17471.494;8237.015;1204.717
15:17:09	17471.476;8237.016;1204.707
15:17:12	17484.950;8237.795;1204.422
15:17:16	17495.799;8238.103;1204.241
15:17:16	17495.808;8238.113;1204.243
15:17:17	17495.811;8238.106;1204.244
15:17:17	17495.816;8238.108;1204.244
15:17:17	17495.816;8238.108;1204.244
15:17:19	17508.074;8238.613;1204.004
15:17:19	17508.074;8238.613;1204.004
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""")

# ---- group: Robot Pose for Probed points 04
panel = Panel("""0.49641
0.49233
0.51699
-0.49387""")
panel_2 = Panel("""14886.25
6303.96
1210.58""")
python = GhPythonScript(point=panel_2, quaternion=panel)  # -> out, robot_frame, preview; inputs point: list, quaternion: list
# ---------- python: Python ----------
__author__ = "leungp"
__version__ = "2020.07.13"

import rhinoscriptsyntax as rs

from compas.geometry import Frame
from compas_ghpython import draw_frame
robot_frame = Frame.from_quaternion(quaternion, point)
preview = draw_frame(robot_frame)
# ---------- end python ----------

# ----
# First Fitting
number_slider_3 = Slider(-0.09238, range=-5..5)
number_slider_4 = Slider(0.03419, range=-5..5)
number_slider_5 = Slider(-0.17072, range=-5..5)
number_slider_6 = Slider(0.00246, range=-0.05..0.05)
number_slider_7 = Slider(0.00022, range=-0.05..0.05)
number_slider_8 = Slider(-0.00256, range=-0.05..0.05)
xy_plane_pts_2 = Point(duppt)
xz_plane_pts_2 = Point(duppt_2)
yz_plane_pts_2 = Point(duppt_3)
fitting_frame = FittingFrame(
    pt=xy_plane_pts_2,
    pt_2=xz_plane_pts_2,
    pt_3=yz_plane_pts_2,
    F_3=number_slider_3,
    F_2=number_slider_4,
    F=number_slider_5,
    N=number_slider_6,
    N_2=number_slider_7,
    N_3=number_slider_8)  # -> lsq_fitness, D, D_2, D_3, pln_2
galapagos = Galapagos(
    fitness=fitting_frame,
    gene=[number_slider_3, number_slider_4, number_slider_5, number_slider_6, number_slider_7, number_slider_8])
fitness = Panel(fitting_frame.lsq_fitness)
pln_gripper_on_robot = Plane(fitting_frame.pln_2)
abs = Absolute(Value=[fitting_frame.D, fitting_frame.D_2, fitting_frame.D_3])
sort = SortList(Keys=abs)  # -> reverse(Keys), ValuesA
error_distance = Panel(sort.Keys)

# ----
# Main Plane
# gripper_storage
# X Plane
# Y Plane
pt_4 = Point(duppt_4)
pt_5 = Point(duppt_5)
pt_6 = Point(duppt_6)
multiplication = Multiplication(A=Slider(0.0376, range=-0.05..0.05), B="0.01")
multiplication_2 = Multiplication(A=Slider(-0.03755, range=-0.05..0.05), B="0.01")
multiplication_3 = Multiplication(A=Slider(0.00169, range=-0.05..0.05), B="0.01")
cluster = FittingFrame(
    pt=pt_4,
    pt_2=pt_5,
    pt_3=pt_6,
    F_3=Slider(0.96727, range=-5..5),
    F_2=Slider(-0.18887, range=-5..5),
    F=Slider(0.07187, range=-5..5),
    N=multiplication,
    N_2=multiplication_2,
    N_3=multiplication_3)  # -> lsq_fitness, D, D_2, D_3, pln_2
galapagos_2 = Galapagos()
pln_gripper_storage = Plane(cluster.pln_2)
fitness_2 = Panel(cluster.lsq_fitness)
abs_2 = Absolute(Value=[cluster.D, cluster.D_2, cluster.D_3])
sort_2 = SortList(Keys=abs_2)  # -> reverse(Keys), ValuesA
error_distance_2 = Panel(sort_2.Keys)

python_2 = PythonScript(str_list=probed_points_4)  # -> points; inputs str_list: list
# ---------- python_2: Python ----------
import Rhino.Geometry as rg

points = []

for line in str_list:
    tabs = line.split("\t")
    
    values = tabs[1].split(";")
    
    pt = rg.Point3d( float(values[0]), float(values[1]), float(values[2]) )
    
    if pt.X != 0.0 and pt.Y != 0.0 and pt.Z != 0.0:
        points.append(pt)
# ---------- end python_2 ----------
robot_frame_for_probed_point_4 = Plane(python.preview)
points = Data(python_2)
ghpython_script = GhPythonScript(igps_points=points)  # -> robotworld_points; inputs igps_points: list of Point3d
# ---------- ghpython_script: Python ----------
import compas.geometry as cg
import ghpythonlib.components as ghcomp
import Rhino.Geometry as rg
from compas_ghpython import draw_frame



# iGPS world - Robot worls offsets
robot_11_igps_wobj0 = ((-2614.766, -2058.444, 29.420), (1.0, -0.000028, 0.000047, -0.000034))
robot_12_igps_wobj0 = ((-2609.441, -2057.051, 28.106), (1.0, -0.000026, -0.000042, 0.000059))


def transf(obj, rg_T, cg_T):
    if isinstance(obj, rg.Plane):
        return ghcomp.Transform(obj, rg_T)

    elif isinstance(obj, rg.Brep):
        return ghcomp.Transform(obj, rg_T)

    elif isinstance(obj, rg.Mesh):
        return ghcomp.Transform(obj, rg_T)

    elif isinstance(obj, rg.Point3d):
        return ghcomp.Transform(obj, rg_T)

    elif "compas" in str(type(obj)):
        return obj.transformed(cg_T)

    else:
        raise NotImplementedError


def iGPSWorld_to_RobotWorld(obj, robot="robot_11"):

    if robot == "robot_11":
        robot_igps_wobj0 = robot_11_igps_wobj0
    elif robot == "robot_12":
        robot_igps_wobj0 = robot_12_igps_wobj0
    else:
        raise NotImplementedError

    # iGPSworld to RobotWorld transformation
    rg_iGPS_to_robot_world_vector = rg.Vector3d(*robot_igps_wobj0[0])
    
    
    
    
    to_frame = cg.Frame.from_quaternion(robot_11_igps_wobj0[1], point=robot_11_igps_wobj0[0])
    to_plane = draw_frame(to_frame)
    
    rg_iGPS_to_robot_world_T = rg.Transform.PlaneToPlane(rg.Plane.WorldXY, to_plane)
    
    cg_iGPS_to_robot_world_T = None
    """
    cg_iGPS_to_robot_world_T = cg.Transformation.from_matrix([
        [1, 0, 0, rg_iGPS_to_robot_world_vector.X],
        [0, 1, 0, rg_iGPS_to_robot_world_vector.Y],
        [0, 0, 1, rg_iGPS_to_robot_world_vector.Z],
        [0, 0, 0, 1]])
        """

    if isinstance(obj, list):
        # print " --- iGPSWorld_to_RobotWorld for list"
        return [transf(item, rg_iGPS_to_robot_world_T, cg_iGPS_to_robot_world_T) for item in obj]
    elif obj is None:
        # print " --- iGPSWorld_to_RobotWorld for none"
        return None
    else:
        # print " --- iGPSWorld_to_RobotWorld for single object"
        return transf(obj, rg_iGPS_to_robot_world_T, cg_iGPS_to_robot_world_T)


def RobotWorld_to_iGPSWorld(obj, robot="robot_11"):

    if robot == "robot_11":
        robot_igps_wobj0 = robot_11_igps_wobj0
    elif robot == "robot_12":
        robot_igps_wobj0 = robot_12_igps_wobj0
    else:
        raise NotImplementedError

    # RobotWorld to iGPSworld transformation
    rg_robot_world_to_iGPS_vector = -rg.Vector3d(*robot_igps_wobj0[0])
    rg_robot_to_igps_world_T = rg.Transform.Translation(rg_robot_world_to_iGPS_vector)
    cg_robot_to_igps_world_T = cg.Transformation.from_matrix(
        [[1, 0, 0, rg_robot_world_to_iGPS_vector.X],
         [0, 1, 0, rg_robot_world_to_iGPS_vector.Y],
         [0, 0, 1, rg_robot_world_to_iGPS_vector.Z],
         [0, 0, 0, 1]])

    if isinstance(obj, list):
        # print " --- RobotWorld to iGPSworld for list"
        return [transf(item, rg_robot_to_igps_world_T, cg_robot_to_igps_world_T) for item in obj]
    elif obj is None:
        # print " --- RobotWorld to iGPSworld for none"
        return None
    else:
        # print " --- RobotWorld to iGPSworld for single object"
        return transf(obj, rg_robot_to_igps_world_T, cg_robot_to_igps_world_T)



robotworld_points = iGPSWorld_to_RobotWorld(igps_points)
# ---------- end ghpython_script ----------
probed_points_in_robot_world_coords = Data(ghpython_script)

# ----
# Filter Outlier
percentage_to_removed = Slider(5, range=0..10)
lng = ListLength(List=sort.Keys)
num = Number(percentage_to_removed)
multiplication_4 = Multiplication(A=lng, B=num, C=0.01)
item = ListItem(List=sort.Keys, Index=multiplication_4, Wrap=True)
num_2 = Number(item)
smaller = SmallerThan(FirstNumber=fitting_frame.D, SecondNumber=num_2)  # -> SmallerThan, OrEqualTo
smaller_2 = SmallerThan(FirstNumber=fitting_frame.D_2, SecondNumber=num_2)  # -> SmallerThan, OrEqualTo
smaller_3 = SmallerThan(FirstNumber=fitting_frame.D_3, SecondNumber=num_2)  # -> SmallerThan, OrEqualTo
cull = CullPattern(List=xy_plane_pts_2, CullPattern=smaller.SmallerThan)
cull_2 = CullPattern(List=xz_plane_pts_2, CullPattern=smaller_2.SmallerThan)
cull_3 = CullPattern(List=yz_plane_pts_2, CullPattern=smaller_3.SmallerThan)

flip_plane = FlipPlane(P=pln_gripper_storage, flip_x=Toggle(False), flip_y=Toggle(True))
pln_gripper_storage_2 = Plane(flip_plane)
orient = Orient(Geometry=[xy_plane_pts_2, xz_plane_pts_2, yz_plane_pts_2], Source=pln_gripper_on_robot, Target=pln_gripper_storage_2)  # -> Geometry, Transform

# ----
# Second Fitting
number_slider_9 = Slider(-0.1941, range=-5..5)
number_slider_10 = Slider(-0.04212, range=-5..5)
number_slider_11 = Slider(-0.45595, range=-5..5)
number_slider_12 = Slider(0.00337, range=-0.05..0.05)
number_slider_13 = Slider(0.00032, range=-0.05..0.05)
number_slider_14 = Slider(-0.00544, range=-0.05..0.05)
fitting_frame_2 = FittingFrame(
    pt=cull,
    pt_2=cull_2,
    pt_3=cull_3,
    F_3=number_slider_9,
    F_2=number_slider_10,
    F=number_slider_11,
    N=number_slider_12,
    N_2=number_slider_13,
    N_3=number_slider_14)  # -> lsq_fitness, D, D_2, D_3, pln_2
fitness_3 = Panel(fitting_frame_2.lsq_fitness)
galapagos_3 = Galapagos(
    fitness=fitting_frame_2,
    gene=[number_slider_9, number_slider_10, number_slider_11, number_slider_12, number_slider_13, number_slider_14])
pln_gripper_on_robot_2 = Plane(fitting_frame_2.pln_2)
abs_3 = Absolute(Value=[fitting_frame_2.D, fitting_frame_2.D_2, fitting_frame_2.D_3])
sort_3 = SortList(Keys=abs_3)  # -> reverse(Keys), ValuesA
error_distance_3 = Panel(sort_3.Keys)

# ==== cluster FittingFrame
pt = ClusterInput()
pt_2 = ClusterInput()
pt_3 = ClusterInput()
F = ClusterInput()
F_2 = ClusterInput()
F_3 = ClusterInput()
N = ClusterInput()
N_2 = ClusterInput()
N_3 = ClusterInput()
pt_4 = Point(pt)
pt_5 = Point(pt_2)
pt_6 = Point(pt_3)
pi = Pi(Factor=N)
pi_2 = Pi(Factor=N_2)
pi_3 = Pi(Factor=N_3)

# ----
# Plane Fit Estimate
plfit = PlaneFit(Points=pt_4)  # -> Plane, Deviation
plfit_2 = PlaneFit(Points=pt_5)  # -> Plane, Deviation
plfit_3 = PlaneFit(Points=pt_6)  # -> Plane, Deviation
_3px = PlanePlanePlane(PlaneA=plfit.Plane, PlaneB=plfit_2.Plane, PlaneC=plfit_3.Plane)  # -> Point, LineAB, LineAC, LineBC
pl = ConstructPlane(Origin=_3px.Point, XAxis=_3px.LineAB, YAxis=_3px.LineAC)

# ----
# Transformation
Z = UnitZ(Factor=F)
Y = UnitY(Factor=F_2)
X = UnitX(Factor=F_3)
addition = Addition(A=X, B=Y, C=Z)
move = Move(Geometry=pl, Motion=addition)  # -> Geometry, Transform
xy = XYPlane(Origin=move.Geometry)
xz = XZPlane(Origin=move.Geometry)
yz = YZPlane(Origin=move.Geometry)
rotate = Rotate(Geometry=move.Geometry, Angle=pi, Plane=xy)  # -> Geometry, Transform
rotate_2 = Rotate(Geometry=rotate.Geometry, Angle=pi_2, Plane=xz)  # -> Geometry, Transform
rotate_3 = Rotate(Geometry=rotate_2.Geometry, Angle=pi_3, Plane=yz)  # -> Geometry, Transform

# ----
# Evaluate by least square projection distance.
pln = Plane(rotate_3.Geometry)
deplane = DeconstructPlane(Plane=pln)  # -> Origin, XAxis, YAxis, ZAxis
pl_2 = ConstructPlane(Origin=deplane.Origin, XAxis=deplane.XAxis, YAxis=deplane.YAxis)
pl_3 = ConstructPlane(Origin=deplane.Origin, XAxis=deplane.XAxis, YAxis=deplane.ZAxis)
pl_4 = ConstructPlane(Origin=deplane.Origin, XAxis=deplane.YAxis, YAxis=deplane.ZAxis)
cp = PlaneClosestPoint(Point=pt_4, Plane=pl_2)  # -> Point, UVPoint, Distance
cp_2 = PlaneClosestPoint(Point=pt_5, Plane=pl_3)  # -> Point, UVPoint, Distance
cp_3 = PlaneClosestPoint(Point=pt_6, Plane=pl_4)  # -> Point, UVPoint, Distance
sqr = Square(Value=cp.Distance)
sqr_2 = Square(Value=cp_3.Distance)
sqr_3 = Square(Value=cp_2.Distance)
ma = MassAddition(Input=[sqr, sqr_2, sqr_3])  # -> Result, PartialResults
lng = ListLength(List=[sqr, sqr_2, sqr_3])
division = Division(A=ma.Result, B=lng)

lsq_fitness = ClusterOutput(division)
D = ClusterOutput(cp.Distance)
D_2 = ClusterOutput(cp_2.Distance)
D_3 = ClusterOutput(cp_3.Distance)
pln_2 = ClusterOutput(pln)

# ==== cluster FlipPlane
P = ClusterInput()
flip_x = ClusterInput()
flip_y = ClusterInput()
deplane = DeconstructPlane(Plane=P)  # -> Origin, XAxis, YAxis, ZAxis
flip_x_2 = Boolean(flip_x)
flip_y_2 = Boolean(flip_y)
rev = Reverse(Vector=deplane.XAxis)
rev_2 = Reverse(Vector=deplane.YAxis)
filter = StreamFilter(Gate=flip_x_2, Stream0=deplane.XAxis, Stream1=rev)
filter_2 = StreamFilter(Gate=flip_y_2, Stream0=deplane.YAxis, Stream1=rev_2)
pl = ConstructPlane(Origin=deplane.Origin, XAxis=filter, YAxis=filter_2)
pl_2 = ClusterOutput(pl)
