# Grasshopper definition ProbedPointsConverter_5-6.gh (Grasshopper 1.0.7)
# plug-ins: Kangaroo Components

probed_points_7 = Panel("""20:39:50	25753.000;4239.959;1628.372
20:40:10	25770.596;4260.100;1621.155
20:40:18	25780.668;4262.860;1613.271
20:40:33	25797.011;4251.356;1594.137
20:40:46	25797.888;4230.514;1585.180
20:41:03	25792.287;4217.443;1584.780
20:41:09	25779.568;4205.591;1591.204
20:41:20	25769.100;4202.790;1599.357
20:41:27	25751.948;4216.412;1620.040
20:41:44	25751.591;4234.800;1627.466
20:41:58	25757.099;4247.305;1627.619
20:42:08	25784.781;4228.191;1618.928""")
probed_points_6 = Panel("""12:49:40	23490.622;4640.233;998.539
12:49:40	23490.622;4640.233;998.539
12:50:00	23481.284;4641.296;998.439
12:50:02	23481.333;4641.296;998.449
12:50:22	23462.420;4635.556;992.495
12:50:32	23453.829;4624.798;984.465
12:50:44	23453.090;4613.125;976.428
12:50:52	23457.464;4600.126;968.121
12:51:01	23471.541;4592.185;963.996
12:51:09	23484.925;4589.442;963.697
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""")
probed_points_8 = Panel("""21:08:52	23494.143;4637.002;995.489
21:09:01	23484.775;4638.237;995.971
21:09:18	23479.971;4638.562;995.605
21:09:28	23508.037;4627.102;990.315
21:09:38	23513.372;4616.726;983.679
21:10:18	23504.545;4594.326;967.732
21:10:30	23502.591;4592.852;966.634
21:10:54	23485.180;4587.765;961.408
21:11:40	23471.869;4589.948;961.469
21:11:48	23456.780;4600.279;966.968
21:12:01	23451.676;4610.870;973.557
21:12:11	23461.339;4634.064;990.234
21:12:17	23479.638;4639.902;996.086
21:12:22	23492.771;4638.038;996.006
21:12:30	23480.983;4604.296;992.952""")
probed_points_5 = Panel("""12:25:07	17796.650;6338.160;1563.914
12:25:07	17796.650;6338.160;1563.914
12:25:07	17796.650;6338.160;1563.914
12:25:07	17796.657;6338.155;1563.914
12:25:07	17796.657;6338.155;1563.914
12:25:07	17796.657;6338.155;1563.914
12:25:09	17796.678;6333.744;1563.913
12:25:09	17796.684;6333.739;1563.913
12:25:09	17796.684;6333.739;1563.913
12:25:11	17796.735;6328.528;1563.911
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""")

# ---- group: Robot Pose for Probed points 06
# gripper_on_robot
# 2020 07 01 New Method of Fitting Frame to probed points. Using Estmate and Galapagos
panel = Panel("""0.64236
0.16520
-0.24574
0.70689""")
panel_2 = Panel("""20872.27
2597.80
950.93""")
python = GhPythonScript(point=panel_2, quaternion=panel)  # -> out, robot_frame, preview; inputs point: list, quaternion: list
# ---------- python: Python ----------
__author__ = "leungp"
__version__ = "2020.07.13"

import rhinoscriptsyntax as rs

from compas.geometry import Frame
from compas_ghpython import draw_frame
robot_frame = Frame.from_quaternion(quaternion, point)
preview = draw_frame(robot_frame)
# ---------- end python ----------
robot_frame_for_probed_point_6 = Plane(python.preview)

# ----
# First Fitting
number_slider = Slider(-0.09238, range=-5..5)
number_slider_2 = Slider(0.03419, range=-5..5)
number_slider_3 = Slider(-0.17072, range=-5..5)
number_slider_4 = Slider(0.00246, range=-0.05..0.05)
number_slider_5 = Slider(0.00022, range=-0.05..0.05)
number_slider_6 = Slider(-0.00256, range=-0.05..0.05)
xy_plane_pts = Point([<point referenced from the Rhino model> x51])
xz_plane_pts = Point([<point referenced from the Rhino model> x71])
yz_plane_pts = Point([<point referenced from the Rhino model> x84])
fitting_frame = FittingFrame(
    pt=xy_plane_pts,
    pt_2=xz_plane_pts,
    pt_3=yz_plane_pts,
    F_3=number_slider,
    F_2=number_slider_2,
    F=number_slider_3,
    N=number_slider_4,
    N_2=number_slider_5,
    N_3=number_slider_6)  # -> lsq_fitness, D, D_2, D_3, pln_2
galapagos = Galapagos(
    fitness=fitting_frame,
    gene=[number_slider, number_slider_2, number_slider_3, number_slider_4, number_slider_5, number_slider_6])
fitness = Panel(fitting_frame.lsq_fitness)
pln_gripper_on_robot = Plane(fitting_frame.pln_2)
abs = Absolute(Value=[fitting_frame.D, fitting_frame.D_2, fitting_frame.D_3])
sort = SortList(Keys=abs)  # -> reverse(Keys), ValuesA
error_distance = Panel(sort.Keys)

python_2 = PythonScript(str_list=probed_points_7)  # -> points; inputs str_list: list
# ---------- python_2: Python ----------
import Rhino.Geometry as rg

points = []

for line in str_list:
    tabs = line.split("\t")
    
    values = tabs[1].split(";")
    
    pt = rg.Point3d( float(values[0]), float(values[1]), float(values[2]) )
    
    if pt.X != 0.0 and pt.Y != 0.0 and pt.Z != 0.0:
        points.append(pt)
# ---------- end python_2 ----------
python_3 = PythonScript(str_list=probed_points_6)  # -> points; inputs str_list: list; same code as python_2
python_4 = PythonScript(str_list=probed_points_8)  # -> points; inputs str_list: list; same code as python_2
python_5 = PythonScript(str_list=probed_points_5)  # -> points; inputs str_list: list; same code as python_2
points = Data(python_3)
points_2 = Data(python_2)
points_3 = Data(python_4)
points_4 = Data(python_5)
deplane = DeconstructPlane(Plane=robot_frame_for_probed_point_6)  # -> Origin, XAxis, YAxis, ZAxis
ghpython_script = GhPythonScript(igps_points=points_2)  # -> robotworld_points; inputs igps_points: list of Point3d
# ---------- ghpython_script: Python ----------
import compas.geometry as cg
import ghpythonlib.components as ghcomp
import Rhino.Geometry as rg
from compas_ghpython import draw_frame



# iGPS world - Robot worls offsets
robot_11_igps_wobj0 = ((-2614.766, -2058.444, 29.420), (1.0, -0.000028, 0.000047, -0.000034))
robot_12_igps_wobj0 = ((-2609.441, -2057.051, 28.106), (1.0, -0.000026, -0.000042, 0.000059))


def transf(obj, rg_T, cg_T):
    if isinstance(obj, rg.Plane):
        return ghcomp.Transform(obj, rg_T)

    elif isinstance(obj, rg.Brep):
        return ghcomp.Transform(obj, rg_T)

    elif isinstance(obj, rg.Mesh):
        return ghcomp.Transform(obj, rg_T)

    elif isinstance(obj, rg.Point3d):
        return ghcomp.Transform(obj, rg_T)

    elif "compas" in str(type(obj)):
        return obj.transformed(cg_T)

    else:
        raise NotImplementedError


def iGPSWorld_to_RobotWorld(obj, robot="robot_11"):

    if robot == "robot_11":
        robot_igps_wobj0 = robot_11_igps_wobj0
    elif robot == "robot_12":
        robot_igps_wobj0 = robot_12_igps_wobj0
    else:
        raise NotImplementedError

    # iGPSworld to RobotWorld transformation
    rg_iGPS_to_robot_world_vector = rg.Vector3d(*robot_igps_wobj0[0])
    
    
    
    
    to_frame = cg.Frame.from_quaternion(robot_11_igps_wobj0[1], point=robot_11_igps_wobj0[0])
    to_plane = draw_frame(to_frame)
    
    rg_iGPS_to_robot_world_T = rg.Transform.PlaneToPlane(rg.Plane.WorldXY, to_plane)
    
    cg_iGPS_to_robot_world_T = None
    """
    cg_iGPS_to_robot_world_T = cg.Transformation.from_matrix([
        [1, 0, 0, rg_iGPS_to_robot_world_vector.X],
        [0, 1, 0, rg_iGPS_to_robot_world_vector.Y],
        [0, 0, 1, rg_iGPS_to_robot_world_vector.Z],
        [0, 0, 0, 1]])
        """

    if isinstance(obj, list):
        # print " --- iGPSWorld_to_RobotWorld for list"
        return [transf(item, rg_iGPS_to_robot_world_T, cg_iGPS_to_robot_world_T) for item in obj]
    elif obj is None:
        # print " --- iGPSWorld_to_RobotWorld for none"
        return None
    else:
        # print " --- iGPSWorld_to_RobotWorld for single object"
        return transf(obj, rg_iGPS_to_robot_world_T, cg_iGPS_to_robot_world_T)


def RobotWorld_to_iGPSWorld(obj, robot="robot_11"):

    if robot == "robot_11":
        robot_igps_wobj0 = robot_11_igps_wobj0
    elif robot == "robot_12":
        robot_igps_wobj0 = robot_12_igps_wobj0
    else:
        raise NotImplementedError

    # RobotWorld to iGPSworld transformation
    rg_robot_world_to_iGPS_vector = -rg.Vector3d(*robot_igps_wobj0[0])
    rg_robot_to_igps_world_T = rg.Transform.Translation(rg_robot_world_to_iGPS_vector)
    cg_robot_to_igps_world_T = cg.Transformation.from_matrix(
        [[1, 0, 0, rg_robot_world_to_iGPS_vector.X],
         [0, 1, 0, rg_robot_world_to_iGPS_vector.Y],
         [0, 0, 1, rg_robot_world_to_iGPS_vector.Z],
         [0, 0, 0, 1]])

    if isinstance(obj, list):
        # print " --- RobotWorld to iGPSworld for list"
        return [transf(item, rg_robot_to_igps_world_T, cg_robot_to_igps_world_T) for item in obj]
    elif obj is None:
        # print " --- RobotWorld to iGPSworld for none"
        return None
    else:
        # print " --- RobotWorld to iGPSworld for single object"
        return transf(obj, rg_robot_to_igps_world_T, cg_robot_to_igps_world_T)



robotworld_points = iGPSWorld_to_RobotWorld(igps_points)
# ---------- end ghpython_script ----------
ghpython_script_2 = GhPythonScript(igps_points=points)  # -> robotworld_points; inputs igps_points: list of Point3d; same code as ghpython_script
ghpython_script_3 = GhPythonScript(igps_points=points_3)  # -> robotworld_points; inputs igps_points: list of Point3d; same code as ghpython_script
ghpython_script_4 = GhPythonScript(igps_points=points_4)  # -> robotworld_points; inputs igps_points: list of Point3d; same code as ghpython_script
line = LineSDL(Start=deplane.Origin, Direction=deplane.XAxis, Length=100)
ln = Line()
line_2 = LineSDL(Start=deplane.Origin, Direction=deplane.YAxis, Length=100)
duppt = RemoveDuplicatePts(Points=ghpython_script, Tolerance=Slider(0.001, range=0..0.001))
duppt_2 = RemoveDuplicatePts(Points=ghpython_script_2, Tolerance=Slider(0.001, range=0..0.001))
duppt_3 = RemoveDuplicatePts(Points=ghpython_script_3, Tolerance=Slider(0.001, range=0..0.001))
duppt_4 = RemoveDuplicatePts(Points=ghpython_script_4, Tolerance=Slider(0.001, range=0..0.001))
probed_points_in_robot_world_coords = Data(duppt_2)
probed_points_in_robot_world_coords_2 = Data(duppt_4)
probed_points_in_robot_world_coords_3 = Data(duppt)
probed_points_in_robot_world_coords_4 = Data(duppt_3)

# ----
# Filter Outlier
percentage_to_removed = Slider(5, range=0..10)
lng = ListLength(List=sort.Keys)
num = Number(percentage_to_removed)
multiplication = Multiplication(A=lng, B=num, C=0.01)
item = ListItem(List=sort.Keys, Index=multiplication, Wrap=True)
num_2 = Number(item)
smaller = SmallerThan(FirstNumber=fitting_frame.D, SecondNumber=num_2)  # -> SmallerThan, OrEqualTo
smaller_2 = SmallerThan(FirstNumber=fitting_frame.D_2, SecondNumber=num_2)  # -> SmallerThan, OrEqualTo
smaller_3 = SmallerThan(FirstNumber=fitting_frame.D_3, SecondNumber=num_2)  # -> SmallerThan, OrEqualTo
cull = CullPattern(List=xy_plane_pts, CullPattern=smaller.SmallerThan)
cull_2 = CullPattern(List=xz_plane_pts, CullPattern=smaller_2.SmallerThan)
cull_3 = CullPattern(List=yz_plane_pts, CullPattern=smaller_3.SmallerThan)

# ----
# Second Fitting
number_slider_7 = Slider(-0.1941, range=-5..5)
number_slider_8 = Slider(-0.04212, range=-5..5)
number_slider_9 = Slider(-0.45595, range=-5..5)
number_slider_10 = Slider(0.00337, range=-0.05..0.05)
number_slider_11 = Slider(0.00032, range=-0.05..0.05)
number_slider_12 = Slider(-0.00544, range=-0.05..0.05)
fitting_frame_2 = FittingFrame(
    pt=cull,
    pt_2=cull_2,
    pt_3=cull_3,
    F_3=number_slider_7,
    F_2=number_slider_8,
    F=number_slider_9,
    N=number_slider_10,
    N_2=number_slider_11,
    N_3=number_slider_12)  # -> lsq_fitness, D, D_2, D_3, pln_2
fitness_2 = Panel(fitting_frame_2.lsq_fitness)
galapagos_2 = Galapagos(
    fitness=fitting_frame_2,
    gene=[number_slider_7, number_slider_8, number_slider_9, number_slider_10, number_slider_11, number_slider_12])
pln_gripper_on_robot_2 = Plane(fitting_frame_2.pln_2)
abs_2 = Absolute(Value=[fitting_frame_2.D, fitting_frame_2.D_2, fitting_frame_2.D_3])
sort_2 = SortList(Keys=abs_2)  # -> reverse(Keys), ValuesA
error_distance_2 = Panel(sort_2.Keys)

robot_frame_for_probed_point_6_2 = Plane(Plane(origin=(20872.27, 2597.8, 950.93), x=(-0.1201643267, 0.8269640275, 0.549264082), y=(-0.9893491772, -0.05397004729, -0.1351866844)))
# Measuring probed Points on quickchanger
# Comparing it with the robot pose read from controller.
# (Probe 6)
# SteelSrf
probed_points = Point([<point referenced from the Rhino model> x14])
srf = Surface(<surface referenced from the Rhino model>)
# Alu Surface
probed_points_2 = Point([<point referenced from the Rhino model> x9])

# ----
# Projection to Robot Frame CL
deplane_2 = DeconstructPlane(Plane=robot_frame_for_probed_point_6_2)  # -> Origin, XAxis, YAxis, ZAxis
line_3 = LineSDL(Start=deplane_2.Origin, Direction=deplane_2.ZAxis, Length=1000)
z_axis_of_robot_frame = Curve(line_3)
crv_cp = CurveClosestPoint(Point=probed_points, Curve=z_axis_of_robot_frame)  # -> Point, Parameter, Distance
subtraction = Subtraction(A=crv_cp.Distance, B=31)
sort_3 = SortList(Keys=subtraction)  # -> Keys, ValuesA
panel_3 = Panel(sort_3.Keys)

# ----
# Plane Fit Z Axis Angle
robot_frame_for_probed_point_6_3 = Plane(Plane(origin=(20872.27, 2597.8, 950.93), x=(-0.1201643267, 0.8269640275, 0.549264082), y=(-0.9893491772, -0.05397004729, -0.1351866844)))
plfit = PlaneFit(Points=probed_points)  # -> Plane, Deviation
panel_4 = Panel(plfit.Deviation)
deplane_3 = DeconstructPlane(Plane=plfit.Plane)  # -> Origin, XAxis, YAxis, ZAxis
deplane_4 = DeconstructPlane(Plane=robot_frame_for_probed_point_6_3)  # -> Origin, XAxis, YAxis, ZAxis
angle = Angle(VectorA=deplane_3.ZAxis, VectorB=deplane_4.ZAxis)  # -> Angle, Reflex
deg = Degrees(Radians=angle.Angle)
angle_error_deg = Panel(deg)

srf_2 = Surface(<surface referenced from the Rhino model>)

# ----
# Projection Distance
srf_cp = SurfaceClosestPoint(Point=probed_points, Surface=srf)  # -> Point, UVPoint, Distance
subtraction_2 = Subtraction(A=srf_cp.Distance, B=6)
sort_4 = SortList(Keys=subtraction_2)  # -> Keys, ValuesA
projection_dist_error = Panel(sort_4.Keys)

# ----
# Circle Fit CL to Robot CL
fcircle = CircleFit(Points=probed_points)  # -> Circle, Radius, Deviation
robot_frame_for_probed_point_6_4 = Plane(Plane(origin=(20872.27, 2597.8, 950.93), x=(-0.1201643267, 0.8269640275, 0.549264082), y=(-0.9893491772, -0.05397004729, -0.1351866844)))
should_be_about_31mm = Panel(fcircle.Radius)
pln = Plane(fcircle.Circle)
deplane_5 = DeconstructPlane(Plane=robot_frame_for_probed_point_6_4)  # -> Origin, XAxis, YAxis, ZAxis
deplane_6 = DeconstructPlane(Plane=pln)  # -> Origin, XAxis, YAxis, ZAxis
line_4 = LineSDL(Start=deplane_6.Origin, Direction=deplane_6.ZAxis, Length=1000)
plx = LinePlane(Line=line_4, Plane=robot_frame_for_probed_point_6_4)  # -> Point, ParamL, ParamP
subtraction_3 = Subtraction(A=plx.Point, B=deplane_5.Origin)
dist = Distance(PointA=deplane_5.Origin, PointB=plx.Point)
error_in_robot_frame_coords = Panel(plx.ParamP)
error_in_world_coords = Panel(subtraction_3)
distance = Panel(dist)

# ----
# Plane Fit Z Axis Angle
robot_frame_for_probed_point_6_5 = Plane(Plane(origin=(20872.27, 2597.8, 950.93), x=(-0.1201643267, 0.8269640275, 0.549264082), y=(-0.9893491772, -0.05397004729, -0.1351866844)))
plfit_2 = PlaneFit(Points=probed_points_2)  # -> Plane, Deviation
panel_5 = Panel(plfit_2.Deviation)
deplane_7 = DeconstructPlane(Plane=plfit_2.Plane)  # -> Origin, XAxis, YAxis, ZAxis
deplane_8 = DeconstructPlane(Plane=robot_frame_for_probed_point_6_5)  # -> Origin, XAxis, YAxis, ZAxis
angle_2 = Angle(VectorA=deplane_7.ZAxis, VectorB=deplane_8.ZAxis)  # -> Angle, Reflex
deg_2 = Degrees(Radians=angle_2.Angle)
panel_6 = Panel(deg_2)

# ----
# Projection Distance
srf_cp_2 = SurfaceClosestPoint(Point=probed_points_2, Surface=srf_2)  # -> Point, UVPoint, Distance
subtraction_4 = Subtraction(A=srf_cp_2.Distance, B=6)
sort_5 = SortList(Keys=subtraction_4)  # -> Keys, ValuesA
projection_dist_error_2 = Panel(sort_5.Keys)

probed_points_in_robot_world_coords_5 = Point([<point referenced from the Rhino model> x11])
data_igps_wobj0_igps_tool0 = Data(Plane(origin=(25778.88086, 4231.71582, 1613.863892), x=(-0.7342046407, 0.03919220337, 0.6777960732), y=(-0.2226628095, -0.9570155651, -0.1858560773)))
data_wobj0_igps_tool0 = Data(Plane(origin=(23164.55469, 2171.604736, 1640.626221), x=(-0.7341393087, 0.03927951831, 0.6778617815), y=(-0.2227451418, -0.9570106372, -0.185782782)))
# Measuring probed Points on quickchanger
# (Probe7)
data_wobj0_tool0 = Data(Plane(origin=(23115.31445, 2193.352051, 1584.962036), x=(-0.7389985436, 0.03957325934, 0.6725437604), y=(-0.2200052125, -0.9577201886, -0.1853907947)))
deplane_9 = DeconstructPlane(Plane=data_wobj0_tool0)  # -> Origin, XAxis, YAxis, ZAxis
line_5 = LineSDL(Start=deplane_9.Origin, Direction=deplane_9.YAxis, Length=1000)
fcircle_2 = CircleFit(Points=probed_points_in_robot_world_coords_5)  # -> Circle, Radius, Deviation

# ----
# Circle Fit CL to Robot CL
fcircle_3 = CircleFit(Points=probed_points_in_robot_world_coords_5)  # -> Circle, Radius, Deviation
robot_frame_for_probed_point = Plane(data_wobj0_tool0)
should_be_about_31mm_2 = Panel(fcircle_3.Radius)
pln_2 = Plane(fcircle_3.Circle)
deplane_10 = DeconstructPlane(Plane=robot_frame_for_probed_point)  # -> Origin, XAxis, YAxis, ZAxis
deplane_11 = DeconstructPlane(Plane=pln_2)  # -> Origin, XAxis, YAxis, ZAxis
line_6 = LineSDL(Start=deplane_11.Origin, Direction=deplane_11.ZAxis, Length=1000)
plx_2 = LinePlane(Line=line_6, Plane=robot_frame_for_probed_point)  # -> Point, ParamL, ParamP
subtraction_5 = Subtraction(A=plx_2.Point, B=deplane_10.Origin)
dist_2 = Distance(PointA=deplane_10.Origin, PointB=plx_2.Point)
error_in_robot_frame_coords_2 = Panel(plx_2.ParamP)
error_in_world_coords_2 = Panel(subtraction_5)
distance_2 = Panel(dist_2)

srf_3 = Surface(<surface referenced from the Rhino model>)
orient = Orient(Geometry=fcircle_2.Circle, Source=data_wobj0_tool0, Target=PlaneXY(0, 0, 0))  # -> Geometry, Transform

# ----
# Projection Distance
srf_cp_3 = SurfaceClosestPoint(Point=probed_points_in_robot_world_coords_5, Surface=srf_3)  # -> Point, UVPoint, Distance
subtraction_6 = Subtraction(A=srf_cp_3.Distance, B=6)
sort_6 = SortList(Keys=subtraction_6)  # -> Keys, ValuesA
projection_dist_error_3 = Panel(sort_6.Keys)

probed_points_in_robot_world_coords_6 = Data([Point(20879.78572, 2577.016063, 1022.440902), Point(20870.41785, 2578.251727, 1022.923714), Point(20865.61384, 2578.577033, 1022.558147), Point(20893.67856, 2567.114828, 1017.266151), Point(20899.01223, 2556.738094, 1010.630231), Point(20890.18221, 2534.337801, 994.6853148), Point(20888.22801, 2532.863873, 993.587581), Point(20870.81617, 2527.777764, 988.3635025), Point(20857.50533, 2529.961673, 988.4256315), Point(20842.41755, 2540.294006, 993.9254712), Point(20837.31489, 2550.885723, 1000.514358), Point(20846.98103, 2574.079999, 1017.18915), Point(20865.28098, 2579.917082, 1023.039103), Point(20878.41384, 2578.052185, 1022.957973), Point(20866.62326, 2544.310816, 1019.906971)])
# Measuring probed Points on quickchanger
# (Probe8)
plane_read_from_wobj0_tool0 = Plane(Plane(origin=(20872.67383, 2596.266113, 948.4532471), x=(-0.1200578292, 0.8270020952, 0.549230054), y=(-0.9893655477, -0.05391241532, -0.1350898388)))

# ----
# Circle Fit CL to Robot CL
fcircle_4 = CircleFit(Points=probed_points_in_robot_world_coords_6)  # -> Circle, Radius, Deviation
robot_frame_for_probed_point_2 = Plane(plane_read_from_wobj0_tool0)
should_be_about_31mm_3 = Panel(fcircle_4.Radius)
pln_3 = Plane(fcircle_4.Circle)
deplane_12 = DeconstructPlane(Plane=robot_frame_for_probed_point_2)  # -> Origin, XAxis, YAxis, ZAxis
deplane_13 = DeconstructPlane(Plane=pln_3)  # -> Origin, XAxis, YAxis, ZAxis
line_7 = LineSDL(Start=deplane_13.Origin, Direction=deplane_13.ZAxis, Length=1000)
plx_3 = LinePlane(Line=line_7, Plane=robot_frame_for_probed_point_2)  # -> Point, ParamL, ParamP
subtraction_7 = Subtraction(A=plx_3.Point, B=deplane_12.Origin)
dist_3 = Distance(PointA=deplane_12.Origin, PointB=plx_3.Point)
error_in_robot_frame_coords_3 = Panel(plx_3.ParamP)
error_in_world_coords_3 = Panel(subtraction_7)
distance_3 = Panel(dist_3)

# ----
# Plane Fit Z Axis Angle
robot_frame_for_probed_point_6_6 = Plane(data_wobj0_tool0)
plfit_3 = PlaneFit(Points=probed_points_in_robot_world_coords_5)  # -> Plane, Deviation
panel_7 = Panel(plfit_3.Deviation)
deplane_14 = DeconstructPlane(Plane=plfit_3.Plane)  # -> Origin, XAxis, YAxis, ZAxis
deplane_15 = DeconstructPlane(Plane=robot_frame_for_probed_point_6_6)  # -> Origin, XAxis, YAxis, ZAxis

rev = Reverse(Vector=deplane_15.ZAxis)

angle_3 = Angle(VectorA=deplane_14.ZAxis, VectorB=rev)  # -> Angle, Reflex
deg_3 = Degrees(Radians=angle_3.Angle)
angle_error_deg_2 = Panel(deg_3)

# ==== cluster FittingFrame
pt = ClusterInput()
pt_2 = ClusterInput()
pt_3 = ClusterInput()
F = ClusterInput()
F_2 = ClusterInput()
F_3 = ClusterInput()
N = ClusterInput()
N_2 = ClusterInput()
N_3 = ClusterInput()
pt_4 = Point(pt)
pt_5 = Point(pt_2)
pt_6 = Point(pt_3)
pi = Pi(Factor=N)
pi_2 = Pi(Factor=N_2)
pi_3 = Pi(Factor=N_3)

# ----
# Plane Fit Estimate
plfit = PlaneFit(Points=pt_4)  # -> Plane, Deviation
plfit_2 = PlaneFit(Points=pt_5)  # -> Plane, Deviation
plfit_3 = PlaneFit(Points=pt_6)  # -> Plane, Deviation
_3px = PlanePlanePlane(PlaneA=plfit.Plane, PlaneB=plfit_2.Plane, PlaneC=plfit_3.Plane)  # -> Point, LineAB, LineAC, LineBC
pl = ConstructPlane(Origin=_3px.Point, XAxis=_3px.LineAB, YAxis=_3px.LineAC)

# ----
# Transformation
Z = UnitZ(Factor=F)
Y = UnitY(Factor=F_2)
X = UnitX(Factor=F_3)
addition = Addition(A=X, B=Y, C=Z)
move = Move(Geometry=pl, Motion=addition)  # -> Geometry, Transform
xy = XYPlane(Origin=move.Geometry)
xz = XZPlane(Origin=move.Geometry)
yz = YZPlane(Origin=move.Geometry)
rotate = Rotate(Geometry=move.Geometry, Angle=pi, Plane=xy)  # -> Geometry, Transform
rotate_2 = Rotate(Geometry=rotate.Geometry, Angle=pi_2, Plane=xz)  # -> Geometry, Transform
rotate_3 = Rotate(Geometry=rotate_2.Geometry, Angle=pi_3, Plane=yz)  # -> Geometry, Transform

# ----
# Evaluate by least square projection distance.
pln = Plane(rotate_3.Geometry)
deplane = DeconstructPlane(Plane=pln)  # -> Origin, XAxis, YAxis, ZAxis
pl_2 = ConstructPlane(Origin=deplane.Origin, XAxis=deplane.XAxis, YAxis=deplane.YAxis)
pl_3 = ConstructPlane(Origin=deplane.Origin, XAxis=deplane.XAxis, YAxis=deplane.ZAxis)
pl_4 = ConstructPlane(Origin=deplane.Origin, XAxis=deplane.YAxis, YAxis=deplane.ZAxis)
cp = PlaneClosestPoint(Point=pt_4, Plane=pl_2)  # -> Point, UVPoint, Distance
cp_2 = PlaneClosestPoint(Point=pt_5, Plane=pl_3)  # -> Point, UVPoint, Distance
cp_3 = PlaneClosestPoint(Point=pt_6, Plane=pl_4)  # -> Point, UVPoint, Distance
sqr = Square(Value=cp.Distance)
sqr_2 = Square(Value=cp_3.Distance)
sqr_3 = Square(Value=cp_2.Distance)
ma = MassAddition(Input=[sqr, sqr_2, sqr_3])  # -> Result, PartialResults
lng = ListLength(List=[sqr, sqr_2, sqr_3])
division = Division(A=ma.Result, B=lng)

lsq_fitness = ClusterOutput(division)
D = ClusterOutput(cp.Distance)
D_2 = ClusterOutput(cp_2.Distance)
D_3 = ClusterOutput(cp_3.Distance)
pln_2 = ClusterOutput(pln)
