# Grasshopper definition SendRobotToFrame.gh (Grasshopper 1.0.7)

panel = Panel("""0.73074
0.02248
0.02379
-0.68188""")
panel_2 = Panel("""14647.32
4617.00
743.20""")

panel_3 = Panel("""0.64235
0.16456
-0.24479
0.70738""")
panel_4 = Panel("""20874.39
2611.52
928.62""")
python = GhPythonScript(point=panel_4, quaternion=panel_3)  # -> out, robot_frame, preview; inputs point: list, quaternion: list
# ---------- python: Python ----------
__author__ = "leungp"
__version__ = "2020.07.13"

import rhinoscriptsyntax as rs

from compas.geometry import Frame
from compas_ghpython import draw_frame
robot_frame = Frame.from_quaternion(quaternion, point)
preview = draw_frame(robot_frame)
# ---------- end python ----------
robot_frame_what_is_written_on_pendent_a = Plane(python.preview)  # "Robot Frame (What is written on pendent after correction)"

reload = Button()
python_script = PythonScript(reload=reload)  # inputs reload: Boolean
# ---------- python_script: Python ----------
from compas_rhino.utilities.misc import unload_modules

if reload:
    unload_modules('compas')
    unload_modules('compas_fab')
    unload_modules("roslibpy")
    unload_modules("compas_rrc")
# ---------- end python_script ----------

# ----
# COMPAS RRC - Robot Communication
panel_5 = Panel("192.168.0.117")
init_robot = Button()
restart = Button()
ros = PythonScript(ip=panel_5, restart=restart)  # -> ros_client, is_connected
# ---------- ros: Python ----------
import sys
import time
import logging
import scriptcontext as sc

from compas_fab.backends import RosClient

from System import TimeSpan
from System.Threading import ManualResetEventSlim

LOGGER = logging.getLogger('roslibpy')

key = 'rosclient_%s' % str(ghenv.Component.InstanceGuid)
previous_client = sc.sticky.get(key, None)
if previous_client:
    previous_client.terminate()

ros_client = RosClient(ip, 9090)
sc.sticky[key] = ros_client

waitLock = ManualResetEventSlim(False)

ros_client.on_ready(lambda: waitLock.Set())

if not waitLock.Wait(TimeSpan.FromSeconds(5)):
    raise Exception('Unable to connect to ROS')

LOGGER.info('ROS connection opened')


is_connected = ros_client.is_connected
# ---------- end ros ----------
ghpython_script = GhPythonScript(ros_client=ros.ros_client, init_robot=init_robot)  # -> robot_11, robot_12, robots; inputs init_robot: Boolean
# ---------- ghpython_script: Python ----------
from compas_rrc import *

if ros_client:
    robot_11 = AbbClient(ros_client, "/robot_1")
    robot_12 = AbbClient(ros_client, "/robot_2")
    
    robots = (robot_11, robot_12, None, None)
# ---------- end ghpython_script ----------

python_2 = GhPythonScript(point=panel_2, quaternion=panel)  # -> out, robot_frame, preview; inputs point: list, quaternion: list; same code as python
reading_back_the_flange_pos = Data(Plane(origin=(20878.625, 2638.965332, 884.1379395), x=(-0.1212505651, 0.8307914048, 0.5432162942), y=(-0.9893326586, -0.05663184604, -0.1342152173)))
pln_gripper_storage = Plane(Plane(origin=(15143.33511, 6577.085731, 716.6403627), x=(-0.9999735, 0.001217146491, 0.007177598739), y=(0.001202603462, 0.9999972161, -0.00203013715)))
pln_robot = Plane(python_2.preview)
pln_gripper_on_robot = Plane(Plane(origin=(14574.71476, 4667.567393, 910.8187632), x=(-0.07970579298, 0.994791032, 0.06354360169), y=(-0.9968160618, -0.07940447635, -0.007257279732)))

pln_clamp_on_robot = Plane(Plane(origin=(14721.30288, 4527.612298, 1174.656089), x=(-0.0008523588385, 0.05544149289, -0.9984615738), y=(0.07883241299, -0.9953508783, -0.0553360626)))
pln_clamp_onbeam = Plane(Plane(origin=(15494.14536, 4332.686339, 1502.652901), x=(-0.9995835078, -0.02833524151, -0.005470375807), y=(0.006339107888, -0.03066053716, -0.9995097534)))
# Doubleclick Me!
clamp_storage = Plane(Plane(origin=(15137.95381, 7132.686907, 338.3007638), x=(0.002010530122, -0.01039253879, 0.9999439749), y=(-0.006428653517, -0.9999254672, -0.01037942072)))

pln_in_robotworld_i_the_robot_to = Plane(Plane(origin=(15150.23926, 4987.120605, 1488.27417), x=(0, 0, -1), y=(0, 1, 0)))
panel_6 = Panel(reading_back_the_flange_pos)
robot_frame_target_we_send_to_robot = Plane(pln_in_robotworld_i_the_robot_to)

igps_wobj0_igps_tool0 = GhPythonScript(get_robot_frame=Button(), robot=ghpython_script.robot_11)  # -> plane; inputs get_robot_frame: Boolean
# ---------- igps_wobj0_igps_tool0: Python ----------
from scriptcontext import sticky as st
from compas_rrc import *
from compas_ghpython import draw_frame



# output sticky
guid = str(ghenv.Component.InstanceGuid)
response_key_frame = "robot_frame_" + guid
if response_key_frame not in st:
    st[response_key_frame] = None



if get_robot_frame:
    
    
    # get current robot pose
    robot.send(SetWorkObject('igps_wobj0'))
    robot.send(SetTool('igps_tool0'))
    
    robot.send(CustomInstruction('r_A042_SetWobj', ['igps_wobj0'], [], feedback_level=0))
    
    #robot.send(SetWorkObject('wobj0'))
    #robot.send(SetTool('tool0'))
    
    robot_current_robtarget = robot.send_and_wait(GetRobtarget(), timeout=10)

    robot_current_frame = robot_current_robtarget[0]
    robot_current_external_exes = robot_current_robtarget[1]
    
    st[response_key_frame] = robot_current_frame



plane = draw_frame(st[response_key_frame])
# ---------- end igps_wobj0_igps_tool0 ----------
data_igps_wobj0_igps_tool0 = Data(igps_wobj0_igps_tool0)

# ----
# TASK PERS wobjdata igps_wobj0 := [FALSE, TRUE, "", [[-2614.766,-2058.444,29.420], [1.000000,-0.000028,0.000047,-0.000034]], [[0.000,0.000,0.000], [1.000000,0.000000,0.000000,0.000000]]];
wobj0_tool0 = GhPythonScript(get_robot_frame=Button(), robot=ghpython_script.robot_11)  # -> plane; inputs get_robot_frame: Boolean
# ---------- wobj0_tool0: Python ----------
from scriptcontext import sticky as st
from compas_rrc import *
from compas_ghpython import draw_frame



# output sticky
guid = str(ghenv.Component.InstanceGuid)
response_key_frame = "robot_frame_" + guid
if response_key_frame not in st:
    st[response_key_frame] = None



if get_robot_frame:
    
    
    # get current robot pose
    robot.send(SetWorkObject('wobj0'))
    robot.send(SetTool('tool0'))
    
    #robot.send(SetWorkObject('wobj0'))
    #robot.send(SetTool('tool0'))
    
    robot_current_robtarget = robot.send_and_wait(GetRobtarget(), timeout=10)

    robot_current_frame = robot_current_robtarget[0]
    robot_current_external_exes = robot_current_robtarget[1]
    
    st[response_key_frame] = robot_current_frame



plane = draw_frame(st[response_key_frame])
# ---------- end wobj0_tool0 ----------

wobj0_igps_tool0 = GhPythonScript(get_robot_frame=Button(), robot=ghpython_script.robot_11)  # -> plane; inputs get_robot_frame: Boolean
# ---------- wobj0_igps_tool0: Python ----------
from scriptcontext import sticky as st
from compas_rrc import *
from compas_ghpython import draw_frame



# output sticky
guid = str(ghenv.Component.InstanceGuid)
response_key_frame = "robot_frame_" + guid
if response_key_frame not in st:
    st[response_key_frame] = None



if get_robot_frame:
    
    
    # get current robot pose
    robot.send(SetWorkObject('wobj0'))
    robot.send(SetTool('igps_tool0'))
    
    #robot.send(SetWorkObject('wobj0'))
    #robot.send(SetTool('tool0'))
    
    robot_current_robtarget = robot.send_and_wait(GetRobtarget(), timeout=10)

    robot_current_frame = robot_current_robtarget[0]
    robot_current_external_exes = robot_current_robtarget[1]
    
    st[response_key_frame] = robot_current_frame



plane = draw_frame(st[response_key_frame])
# ---------- end wobj0_igps_tool0 ----------
data_wobj0_igps_tool0 = Data(wobj0_igps_tool0)

igps_wobj0_offset = Data(Plane(origin=(-2614.766, -2058.444, 29.42), x=(0.9999999933, -6.800263172e-05, -9.399809561e-05), y=(6.799736772e-05, 0.9999999961, -5.600319577e-05)))
igps_world_stuff = Data()
robotworld_stuff = Data(robot_frame_target_we_send_to_robot)
orient = Orient(Geometry=robotworld_stuff, Source=igps_wobj0_offset, Target=PlaneXY(0, 0, 0))  # -> Geometry, Transform
orient_2 = Orient(Geometry=igps_world_stuff, Source=PlaneXY(0, 0, 0), Target=igps_wobj0_offset)  # -> Geometry, Transform
igps_world_stuff_2 = Data(orient.Geometry)
robotworld_stuff_2 = Data(orient_2.Geometry)

orient_3 = Orient(Geometry=pln_robot, Source=pln_clamp_on_robot, Target=pln_clamp_onbeam)  # -> Geometry, Transform
orient_4 = Orient(Geometry=pln_robot, Source=pln_gripper_on_robot, Target=pln_gripper_storage)  # -> Geometry, Transform
orient_5 = Orient(Geometry=pln_robot, Source=pln_clamp_on_robot, Target=clamp_storage)  # -> Geometry, Transform
pickup_offset_z = Slider(0, range=0..500)
# T_ROB11/iGPS_OfflineData: TASK PERS tooldata igps_tool0 := [TRUE, [[0.187,-0.324,77.428], [0.999993,-0.001117,-0.003492,-0.000893]], [0.001, [0.000,0.000,0.001], [1.000000,0.000000,0.000000,0.000000], 0.000, 0.000, 0.000]];
pickup_offset_z_2 = Slider(1, range=0..500)
pickup_offset_z_3 = Slider(500, range=0..500)
pickup_offset_y = Slider(10, range=0..500)
send = Button()
plane_read_from_wobj0_tool0 = Plane(wobj0_tool0)
robot11_movetorobtarget = GhPythonScript(send=send, robot=ghpython_script.robot_11)  # -> out; inputs send: Boolean
# ---------- robot11_movetorobtarget: Python ----------
import compas.geometry as cg
from compas_rrc import *
from compas_ghpython import draw_frame

from compas_rhino.geometry import RhinoPlane
target_frame = RhinoPlane.from_geometry(target_plane).to_compas()

if send:
    
    
    
    # send correction
    robot.send(SetWorkObject('wobj0'))
    robot.send(SetTool('tool0'))
    
    
    robot_current_robtarget = robot.send_and_wait(GetRobtarget(), timeout=1)
    robot_current_external_exes = robot_current_robtarget[1]
    
    
    speed = 50 #mm/s
    zone = Zone.FINE

#    robot.send_and_wait(MoveToRobtarget(target_frame, robot_current_external_exes, speed, zone, motion_type=Motion.LINEAR), timeout=1)
    robot.send(MoveToRobtarget(target_frame, robot_current_external_exes, speed, zone, motion_type=Motion.LINEAR))
# ---------- end robot11_movetorobtarget ----------
pln_robot_at_clamp_storage = Plane(orient_4.Geometry)
pln_robot_at_clamp_storage_2 = Plane(orient_5.Geometry)
Z = UnitZ(Factor=pickup_offset_z_2)
Z_2 = UnitZ(Factor=pickup_offset_z_3)
pln_robot_at_clamp_storage_3 = Plane(orient_3.Geometry)
neg = Negative(Value=pickup_offset_z)
neg_2 = Negative(Value=pickup_offset_y)
igps_tool0_offset = Data(Plane(origin=(0.187, -0.324, 77.428), x=(0.999974017, -0.001778185945, 0.006985944403), y=(0.001793788197, 0.9999959097, -0.002227747117)))
move = Move(Geometry=orient_4.Geometry, Motion=Z)  # -> Geometry, Transform
move_2 = Move(Geometry=orient_5.Geometry, Motion=Z_2)  # -> Geometry, Transform
Y = UnitY(Factor=neg_2)
X = UnitX(Factor=neg)
pln = Plane(igps_world_stuff_2)
rec = DataRecorder(robot11_movetorobtarget, DataLimit=-10, RecordData=True)
pln_robot_at_clamp_storage_pickup = Plane(move.Geometry)
pln_robot_at_clamp_storage_pickup_2 = Plane(move_2.Geometry)
panel_7 = Panel(data_wobj0_igps_tool0)
addition = Addition(A=X, B=Y)
panel_8 = Panel(data_igps_wobj0_igps_tool0)
panel_9 = Panel(plane_read_from_wobj0_tool0)
orient_6 = Orient(Geometry=igps_tool0_offset, Source=PlaneXY(0, 0, 0), Target=pln)  # -> Geometry, Transform
yz = YZPlane(Origin=plane_read_from_wobj0_tool0)
panel_10 = Panel(rec)
move_3 = Move(Geometry=orient_3.Geometry, Motion=addition)  # -> Geometry, Transform
prot = RotatePlane(Plane=yz, Angle=degrees(-90))
pln_robot_at_clamp_storage_pickup_3 = Plane(move_3.Geometry)

# ----
# Send to igps_tool0 in igps_wobj0
send_2 = Button()
robot11_movetorobtarget_2 = GhPythonScript(send=send_2, robot=ghpython_script.robot_11, target_plane_igps_tool0=orient_6.Geometry)  # -> out; inputs send: Boolean
# ---------- robot11_movetorobtarget_2: Python ----------
import compas.geometry as cg
from compas_rrc import *
from compas_ghpython import draw_frame

from compas_rhino.geometry import RhinoPlane
target_frame = RhinoPlane.from_geometry(target_plane_igps_tool0).to_compas()


if send:
    

    
    speed = 50 #mm/s
    zone = Zone.FINE

    # Connect with iGPS Server
    string_values = ['Robot11']
    float_values = []
    feedback_level = 0
    robot.send(CustomInstruction('r_A042_iGPS_Connect', string_values, float_values, feedback_level=feedback_level))
    
    # Set Tool
#    robot.send(SetTool('igps_tool0'))
    
    # Set Work Object
#    robot.send(SetWorkObject('igps_wobj0'))
    
    # Set iGPS tool
    robot.send(CustomInstruction('r_A042_iGPS_SetTool', ['tool0'], [], feedback_level=0))
    robot.send(CustomInstruction('r_A042_SetTool', ['igps_tool0'], [], feedback_level=0))
    
    # Set iGPS work object
    robot.send(CustomInstruction('r_A042_iGPS_SetWobj', ['wobj0'], [], feedback_level=0))
    robot.send(CustomInstruction('r_A042_SetWobj', ['igps_wobj0'], [], feedback_level=0))
    
    
    
    # Get frame
    frame, external_axes = robot.send_and_wait(GetRobtarget(), timeout=10)
    print('GetRobtarget Result = ', frame.point, frame.quaternion , external_axes)
    
    # iGPS move and correct
    # Note that r_A042_iGPS_MoveL only works with igps_tool0.
    
    
    string_values = []
    float_values = list(target_frame.point) + list(target_frame.quaternion) + list(external_axes) + [50.0] + [Zone.FINE]
    feedback_level = 1
    done = robot.send_and_wait(CustomInstruction('r_A042_iGPS_MoveL', string_values, float_values, feedback_level=feedback_level), timeout=60)

    # Get frame
    frame, external_axes = robot.send_and_wait(GetRobtarget(), timeout=10)
    print('GetRobtarget Result = ', frame.point, frame.quaternion , external_axes)
# ---------- end robot11_movetorobtarget_2 ----------
rec_2 = DataRecorder(robot11_movetorobtarget_2, DataLimit=-10, RecordData=True)
panel_11 = Panel(rec_2)

# ----
# igps_tool0 Offset
panel_12 = Panel("""0.999993
-0.001117
-0.003492
-0.000893""")
panel_13 = Panel("""0.187
-0.324
77.428""")
python_3 = GhPythonScript(point=panel_13, quaternion=panel_12)  # -> out, robot_frame, preview; inputs point: list, quaternion: list; same code as python
igps_tool0_offset_2 = Data(python_3.preview)

send_3 = Button()
robot11_movetorobtarget_3 = GhPythonScript(send=send_3, robot=ghpython_script.robot_11)  # -> out; inputs send: Boolean
# ---------- robot11_movetorobtarget_3: Python ----------
import compas.geometry as cg
from compas_rrc import *
from compas_ghpython import draw_frame



if send:
    

    
    speed = 50 #mm/s
    zone = Zone.FINE

    # Connect with iGPS Server
    string_values = ['Robot11']
    float_values = []
    feedback_level = 0
    robot.send(CustomInstruction('r_A042_iGPS_Connect', string_values, float_values, feedback_level=feedback_level))
    
    # Set Tool
#    robot.send(SetTool('igps_tool0'))
    
    # Set Work Object
#    robot.send(SetWorkObject('igps_wobj0'))
    
    # Set iGPS tool
    robot.send(CustomInstruction('r_A042_iGPS_SetTool', ['tool0'], [], feedback_level=0))
    robot.send(CustomInstruction('r_A042_SetTool', ['igps_tool0'], [], feedback_level=0))
    
    # Set iGPS work object
    robot.send(CustomInstruction('r_A042_iGPS_SetWobj', ['wobj0'], [], feedback_level=0))
    robot.send(CustomInstruction('r_A042_SetWobj', ['igps_wobj0'], [], feedback_level=0))
    
    
    
    # Get frame
    frame, external_axes = robot.send_and_wait(GetRobtarget(), timeout=10)
    print('GetRobtarget Result = ', frame.point, frame.quaternion , external_axes)
    
    # iGPS move and correct
    # Note that r_A042_iGPS_MoveL only works with igps_tool0.
    
    
    string_values = []
    float_values = list(frame.point) + list(frame.quaternion) + list(external_axes) + [50.0] + [Zone.FINE]
    feedback_level = 1
    done = robot.send_and_wait(CustomInstruction('r_A042_iGPS_MoveL', string_values, float_values, feedback_level=feedback_level), timeout=60)

    # Get frame
    frame, external_axes = robot.send_and_wait(GetRobtarget(), timeout=10)
    print('GetRobtarget Result = ', frame.point, frame.quaternion , external_axes)
# ---------- end robot11_movetorobtarget_3 ----------
rec_3 = DataRecorder(robot11_movetorobtarget_3, DataLimit=-10, RecordData=True)
panel_14 = Panel(rec_3)

# ----
# igps_wobj0 Offset
panel_15 = Panel("""1.000000
-0.000028
0.000047
-0.000034""")
panel_16 = Panel("""-2614.766
-2058.444
29.420""")
python_4 = GhPythonScript(point=panel_16, quaternion=panel_15)  # -> out, robot_frame, preview; inputs point: list, quaternion: list; same code as python
igps_wobj0_offset_2 = Data(python_4.preview)
