# Grasshopper definition SendRobotToFrame.gh (Grasshopper 1.0.7)

# ----
# Qaternion to Frame
panel = Panel("""23237.5
4567.06
935.09""")
panel_2 = Panel("""0.00802
-0.68335
-0.00317
-0.73004""")
quaternion_to_frame = GhPythonScript(point=panel, quaternion=panel_2)  # -> out, compas_frame, rhino_plane; inputs point: list, quaternion: list
# ---------- quaternion_to_frame: Python ----------
__author__ = "leungp"
__version__ = "2020.07.13"

import rhinoscriptsyntax as rs

from compas.geometry import Frame
from compas_ghpython import draw_frame
compas_frame = Frame.from_quaternion(quaternion, point)
rhino_plane = draw_frame(compas_frame)
# ---------- end quaternion_to_frame ----------
pln_robot = Plane(quaternion_to_frame.rhino_plane)

reload = Button()
python_script = PythonScript(reload=reload)  # inputs reload: Boolean
# ---------- python_script: Python ----------
from compas_rhino.utilities.misc import unload_modules

if reload:
    unload_modules('compas')
    unload_modules('compas_fab')
    unload_modules("roslibpy")
    unload_modules("compas_rrc")
# ---------- end python_script ----------

# ----
# COMPAS RRC - Robot Communication
panel_3 = Panel("192.168.0.117")
init_robot = Button()
restart = Button()
ros = PythonScript(ip=panel_3, restart=restart)  # -> ros_client, is_connected
# ---------- ros: Python ----------
import sys
import time
import logging
import scriptcontext as sc

from compas_fab.backends import RosClient

from System import TimeSpan
from System.Threading import ManualResetEventSlim

LOGGER = logging.getLogger('roslibpy')

key = 'rosclient_%s' % str(ghenv.Component.InstanceGuid)
previous_client = sc.sticky.get(key, None)
if previous_client:
    previous_client.terminate()

ros_client = RosClient(ip, 9090)
sc.sticky[key] = ros_client

waitLock = ManualResetEventSlim(False)

ros_client.on_ready(lambda: waitLock.Set())

if not waitLock.Wait(TimeSpan.FromSeconds(5)):
    raise Exception('Unable to connect to ROS')

LOGGER.info('ROS connection opened')


is_connected = ros_client.is_connected
# ---------- end ros ----------
ghpython_script = GhPythonScript(ros_client=ros.ros_client, init_robot=init_robot)  # -> robot_11, robot_12, robots; inputs init_robot: Boolean
# ---------- ghpython_script: Python ----------
from compas_rrc import *

if ros_client:
    robot_11 = AbbClient(ros_client, "/robot_1")
    robot_12 = AbbClient(ros_client, "/robot_2")
    
    robots = (robot_11, robot_12, None, None)
# ---------- end ghpython_script ----------

pln_in_robotworld_i_the_robot_to = Plane(Plane(origin=(15150.23926, 4987.120605, 1488.27417), x=(0, 0, -1), y=(0, 1, 0)))

# ----
# igps_tool0 Offset
panel_4 = Panel("""0.999993
-0.001117
-0.003492
-0.000893""")
panel_5 = Panel("""0.187
-0.324
77.428""")
python = GhPythonScript(point=panel_5, quaternion=panel_4)  # -> out, robot_frame, preview; inputs point: list, quaternion: list
# ---------- python: Python ----------
__author__ = "leungp"
__version__ = "2020.07.13"

import rhinoscriptsyntax as rs

from compas.geometry import Frame
from compas_ghpython import draw_frame
robot_frame = Frame.from_quaternion(quaternion, point)
preview = draw_frame(robot_frame)
# ---------- end python ----------
# T_ROB11/iGPS_OfflineData: TASK PERS tooldata igps_tool0 := [TRUE, [[0.187,-0.324,77.428], [0.999993,-0.001117,-0.003492,-0.000893]], [0.001, [0.000,0.000,0.001], [1.000000,0.000000,0.000000,0.000000], 0.000, 0.000, 0.000]];
igps_tool0_offset = Data(python.preview)

robot_frame_target_we_send_to_robot = Plane(pln_in_robotworld_i_the_robot_to)

igps_wobj0_igps_tool0 = GhPythonScript(get_robot_frame=Button(), robot=ghpython_script.robot_12)  # -> plane; inputs get_robot_frame: Boolean
# ---------- igps_wobj0_igps_tool0: Python ----------
from scriptcontext import sticky as st
from compas_rrc import *
from compas_ghpython import draw_frame



# output sticky
guid = str(ghenv.Component.InstanceGuid)
response_key_frame = "robot_frame_" + guid
if response_key_frame not in st:
    st[response_key_frame] = None



if get_robot_frame:
    
    
    # get current robot pose
    robot.send(SetWorkObject('igps_wobj0'))
    robot.send(SetTool('igps_tool0'))
    
    robot.send(CustomInstruction('r_A042_SetWobj', ['igps_wobj0'], [], feedback_level=0))
    
    #robot.send(SetWorkObject('wobj0'))
    #robot.send(SetTool('tool0'))
    
    robot_current_robtarget = robot.send_and_wait(GetRobtarget(), timeout=10)

    robot_current_frame = robot_current_robtarget[0]
    robot_current_external_exes = robot_current_robtarget[1]
    
    st[response_key_frame] = robot_current_frame



plane = draw_frame(st[response_key_frame])
# ---------- end igps_wobj0_igps_tool0 ----------
data_igps_wobj0_igps_tool0 = Data(igps_wobj0_igps_tool0)

# ----
# Reading frame fom Robot
button = Button()
# TASK PERS wobjdata igps_wobj0 := [FALSE, TRUE, "", [[-2614.766,-2058.444,29.420], [1.000000,-0.000028,0.000047,-0.000034]], [[0.000,0.000,0.000], [1.000000,0.000000,0.000000,0.000000]]];
wobj0_tool0 = GhPythonScript(get_robot_frame=button, robot=ghpython_script.robot_12)  # -> plane; inputs get_robot_frame: Boolean
# ---------- wobj0_tool0: Python ----------
from scriptcontext import sticky as st
from compas_rrc import *
from compas_ghpython import draw_frame



# output sticky
guid = str(ghenv.Component.InstanceGuid)
response_key_frame = "robot_frame_" + guid
if response_key_frame not in st:
    st[response_key_frame] = None



if get_robot_frame:
    
    
    # get current robot pose
    robot.send(SetWorkObject('wobj0'))
    robot.send(SetTool('tool0'))
    
    #robot.send(SetWorkObject('wobj0'))
    #robot.send(SetTool('tool0'))
    
    robot_current_robtarget = robot.send_and_wait(GetRobtarget(), timeout=10)

    robot_current_frame = robot_current_robtarget[0]
    robot_current_external_exes = robot_current_robtarget[1]
    
    st[response_key_frame] = robot_current_frame



plane = draw_frame(st[response_key_frame])
# ---------- end wobj0_tool0 ----------

wobj0_igps_tool0 = GhPythonScript(get_robot_frame=Button(), robot=ghpython_script.robot_12)  # -> plane; inputs get_robot_frame: Boolean
# ---------- wobj0_igps_tool0: Python ----------
from scriptcontext import sticky as st
from compas_rrc import *
from compas_ghpython import draw_frame



# output sticky
guid = str(ghenv.Component.InstanceGuid)
response_key_frame = "robot_frame_" + guid
if response_key_frame not in st:
    st[response_key_frame] = None



if get_robot_frame:
    
    
    # get current robot pose
    robot.send(SetWorkObject('wobj0'))
    robot.send(SetTool('igps_tool0'))
    
    #robot.send(SetWorkObject('wobj0'))
    #robot.send(SetTool('tool0'))
    
    robot_current_robtarget = robot.send_and_wait(GetRobtarget(), timeout=10)

    robot_current_frame = robot_current_robtarget[0]
    robot_current_external_exes = robot_current_robtarget[1]
    
    st[response_key_frame] = robot_current_frame



plane = draw_frame(st[response_key_frame])
# ---------- end wobj0_igps_tool0 ----------
data_wobj0_igps_tool0 = Data(wobj0_igps_tool0)

# ---- group: igps robotworld converter
igps_wobj0_offset = Data(Plane(origin=(-2614.766, -2058.444, 29.42), x=(0.9999999933, -6.800263172e-05, -9.399809561e-05), y=(6.799736772e-05, 0.9999999961, -5.600319577e-05)))
robotworld_stuff = Data(robot_frame_target_we_send_to_robot)
igps_world_stuff = Data()
orient = Orient(Geometry=robotworld_stuff, Source=igps_wobj0_offset, Target=PlaneXY(0, 0, 0))  # -> Geometry, Transform
orient_2 = Orient(Geometry=igps_world_stuff, Source=PlaneXY(0, 0, 0), Target=igps_wobj0_offset)  # -> Geometry, Transform
igps_world_stuff_2 = Data(orient.Geometry)
robotworld_stuff_2 = Data(orient_2.Geometry)

# ----
send = Button()
plane_read_from_wobj0_tool0 = Plane(wobj0_tool0)

# ----
# igps_wobj0 Offset
panel_6 = Panel("""1.000000
-0.000028
0.000047
-0.000034""")
panel_7 = Panel("""-2614.766
-2058.444
29.420""")
python_2 = GhPythonScript(point=panel_7, quaternion=panel_6)  # -> out, robot_frame, preview; inputs point: list, quaternion: list; same code as python
igps_wobj0_offset_2 = Data(python_2.preview)

robot11_movetorobtarget = GhPythonScript(send=send, robot=ghpython_script.robot_12)  # -> out; inputs send: Boolean
# ---------- robot11_movetorobtarget: Python ----------
import compas.geometry as cg
from compas_rrc import *
from compas_ghpython import draw_frame

from compas_rhino.geometry import RhinoPlane
target_frame = RhinoPlane.from_geometry(target_plane).to_compas()

if send:
    
    
    
    # send correction
    robot.send(SetWorkObject('wobj0'))
    robot.send(SetTool('tool0'))
    
    
    robot_current_robtarget = robot.send_and_wait(GetRobtarget(), timeout=1)
    robot_current_external_exes = robot_current_robtarget[1]
    
    
    speed = 50 #mm/s
    zone = Zone.FINE

#    robot.send_and_wait(MoveToRobtarget(target_frame, robot_current_external_exes, speed, zone, motion_type=Motion.LINEAR), timeout=1)
    robot.send(MoveToRobtarget(target_frame, robot_current_external_exes, speed, zone, motion_type=Motion.LINEAR))
# ---------- end robot11_movetorobtarget ----------
igps_tool0_offset_2 = Data(Plane(origin=(0.187, -0.324, 77.428), x=(0.999974017, -0.001778185945, 0.006985944403), y=(0.001793788197, 0.9999959097, -0.002227747117)))
pln = Plane(igps_world_stuff_2)
rec = DataRecorder(robot11_movetorobtarget, DataLimit=-10, RecordData=True)
panel_8 = Panel(data_wobj0_igps_tool0)
panel_9 = Panel(data_igps_wobj0_igps_tool0)
panel_10 = Panel(plane_read_from_wobj0_tool0)
orient_3 = Orient(Geometry=igps_tool0_offset_2, Source=PlaneXY(0, 0, 0), Target=pln)  # -> Geometry, Transform
panel_11 = Panel(rec)

# ---- group: Make that frame snap
yz = YZPlane(Origin=plane_read_from_wobj0_tool0)
prot = RotatePlane(Plane=yz, Angle=degrees(-90))

# ----
# Send to igps_tool0 in igps_wobj0
send_2 = Button()
robot11_movetorobtarget_2 = GhPythonScript(send=send_2, robot=ghpython_script.robot_12, target_plane_igps_tool0=orient_3.Geometry)  # -> out; inputs send: Boolean
# ---------- robot11_movetorobtarget_2: Python ----------
import compas.geometry as cg
from compas_rrc import *
from compas_ghpython import draw_frame

from compas_rhino.geometry import RhinoPlane
target_frame = RhinoPlane.from_geometry(target_plane_igps_tool0).to_compas()


if send:
    

    
    speed = 50 #mm/s
    zone = Zone.FINE

    # Connect with iGPS Server
    string_values = ['Robot11']
    float_values = []
    feedback_level = 0
    robot.send(CustomInstruction('r_A042_iGPS_Connect', string_values, float_values, feedback_level=feedback_level))
    
    # Set Tool
#    robot.send(SetTool('igps_tool0'))
    
    # Set Work Object
#    robot.send(SetWorkObject('igps_wobj0'))
    
    # Set iGPS tool
    robot.send(CustomInstruction('r_A042_iGPS_SetTool', ['tool0'], [], feedback_level=0))
    robot.send(CustomInstruction('r_A042_SetTool', ['igps_tool0'], [], feedback_level=0))
    
    # Set iGPS work object
    robot.send(CustomInstruction('r_A042_iGPS_SetWobj', ['wobj0'], [], feedback_level=0))
    robot.send(CustomInstruction('r_A042_SetWobj', ['igps_wobj0'], [], feedback_level=0))
    
    
    
    # Get frame
    frame, external_axes = robot.send_and_wait(GetRobtarget(), timeout=10)
    print('GetRobtarget Result = ', frame.point, frame.quaternion , external_axes)
    
    # iGPS move and correct
    # Note that r_A042_iGPS_MoveL only works with igps_tool0.
    
    
    string_values = []
    float_values = list(target_frame.point) + list(target_frame.quaternion) + list(external_axes) + [50.0] + [Zone.FINE]
    feedback_level = 1
    done = robot.send_and_wait(CustomInstruction('r_A042_iGPS_MoveL', string_values, float_values, feedback_level=feedback_level), timeout=60)

    # Get frame
    frame, external_axes = robot.send_and_wait(GetRobtarget(), timeout=10)
    print('GetRobtarget Result = ', frame.point, frame.quaternion , external_axes)
# ---------- end robot11_movetorobtarget_2 ----------
rec_2 = DataRecorder(robot11_movetorobtarget_2, DataLimit=-10, RecordData=True)
panel_12 = Panel(rec_2)

# ----
# Read joint value from robot
button_2 = Button()
wobj0_tool0_2 = GhPythonScript(get_robot_frame=button_2, robot=ghpython_script.robot_12)  # -> plane, RobotJoints_ExternalAxes_tuple, RobotJoints, ExternalAxes; inputs get_robot_frame: Boolean
# ---------- wobj0_tool0_2: Python ----------
from scriptcontext import sticky as st
from compas_rrc import *
from compas_ghpython import draw_frame



# output sticky
guid = str(ghenv.Component.InstanceGuid)
response = "robot_frame_" + guid
if response not in st:
    st[response] = None



if get_robot_frame:
    #st[response] = robot_current_frame
    
    # get current robot pose
    robot.send(SetWorkObject('wobj0'))
    robot.send(SetTool('tool0'))
    
    st[response] = robot.send_and_wait(GetJoints(), timeout=10)

    
print (st[response][0])
print (st[response][1])
RobotJoints_ExternalAxes_tuple = st[response] 
RobotJoints = st[response][0].values
ExternalAxes = st[response][1].values
#plane = draw_frame(st[response_key_frame])
# ---------- end wobj0_tool0_2 ----------
plane_read_from_wobj0_tool0_2 = Plane(wobj0_tool0_2.plane)
robotjoints = Panel(wobj0_tool0_2.RobotJoints)
external_axis = Panel(wobj0_tool0_2.ExternalAxes)

send_3 = Button()
robot11_movetorobtarget_3 = GhPythonScript(send=send_3, robot=ghpython_script.robot_12)  # -> out; inputs send: Boolean
# ---------- robot11_movetorobtarget_3: Python ----------
import compas.geometry as cg
from compas_rrc import *
from compas_ghpython import draw_frame



if send:
    

    
    speed = 50 #mm/s
    zone = Zone.FINE

    # Connect with iGPS Server
    string_values = ['Robot11']
    float_values = []
    feedback_level = 0
    robot.send(CustomInstruction('r_A042_iGPS_Connect', string_values, float_values, feedback_level=feedback_level))
    
    # Set Tool
#    robot.send(SetTool('igps_tool0'))
    
    # Set Work Object
#    robot.send(SetWorkObject('igps_wobj0'))
    
    # Set iGPS tool
    robot.send(CustomInstruction('r_A042_iGPS_SetTool', ['tool0'], [], feedback_level=0))
    robot.send(CustomInstruction('r_A042_SetTool', ['igps_tool0'], [], feedback_level=0))
    
    # Set iGPS work object
    robot.send(CustomInstruction('r_A042_iGPS_SetWobj', ['wobj0'], [], feedback_level=0))
    robot.send(CustomInstruction('r_A042_SetWobj', ['igps_wobj0'], [], feedback_level=0))
    
    
    
    # Get frame
    frame, external_axes = robot.send_and_wait(GetRobtarget(), timeout=10)
    print('GetRobtarget Result = ', frame.point, frame.quaternion , external_axes)
    
    # iGPS move and correct
    # Note that r_A042_iGPS_MoveL only works with igps_tool0.
    
    
    string_values = []
    float_values = list(frame.point) + list(frame.quaternion) + list(external_axes) + [50.0] + [Zone.FINE]
    feedback_level = 1
    done = robot.send_and_wait(CustomInstruction('r_A042_iGPS_MoveL', string_values, float_values, feedback_level=feedback_level), timeout=60)

    # Get frame
    frame, external_axes = robot.send_and_wait(GetRobtarget(), timeout=10)
    print('GetRobtarget Result = ', frame.point, frame.quaternion , external_axes)
# ---------- end robot11_movetorobtarget_3 ----------
rec_3 = DataRecorder(robot11_movetorobtarget_3, DataLimit=-10, RecordData=True)
panel_13 = Panel(rec_3)
