# Grasshopper definition 1_Beam Angle Visualization - Assembly Vector Problem.gh (Grasshopper 1.0.7)
# plug-ins: Human

beam_width_this_is_the_depth_z_axis = Slider(100, range=0..100)
beam_length = Slider(400, range=0..1000)
offset = Slider(75, range=0..100)
out_of_plane_angle = Slider(10, range=-46..45)
axial_angle = Slider(45, range=-46..45)
bake = Button()
planar_angle = Slider(60, range=0..100)
member_distance_offset = Slider(50, range=0..100)
beam_height = Slider(100, range=0..100)
subtraction = Subtraction(A=offset, B=100)
division = Division(A=beam_height, B=2)
division_2 = Division(A=beam_width_this_is_the_depth_z_axis, B=2)
neg = Negative(Value=axial_angle)
yz = YZPlane(Origin=Point(0, 0, 0))
xz = XZPlane(Origin=Point(0, 0, 0))
box = CenterBox(Base=PlaneXY(0, 0, 0), X=beam_length, Y=division, Z=division_2)
xy = XYPlane(Origin=Point(0, 0, 0))
rotate = Rotate(Geometry=box, Angle=degrees(neg), Plane=yz)  # -> Geometry, Transform
rotate_2 = Rotate(Geometry=rotate.Geometry, Angle=degrees(out_of_plane_angle), Plane=xz)  # -> Geometry, Transform
neg_2 = Negative(Value=member_distance_offset)
rotate_3 = Rotate(Geometry=rotate_2.Geometry, Angle=degrees(planar_angle), Plane=xy)  # -> Geometry, Transform
Z = UnitZ(Factor=neg_2)
move = Move(Geometry=rotate_3.Geometry, Motion=Z)  # -> Geometry, Transform
moving_beam = Geometry(box)
subtraction_2 = Subtraction(A=member_distance_offset, B=beam_width_this_is_the_depth_z_axis)
non_moving_beam = Geometry(move.Geometry)
non_moving_beam_2 = Geometry(move.Geometry)
non_moving_beam_3 = Geometry(move.Geometry)
moving_beam_2 = Geometry(box)
moving_beam_3 = Geometry(box)
max = Maximum(B="-10")
concat = Concatenate(
    FragmentA=axial_angle,
    FragmentB="_",
    FragmentC=out_of_plane_angle,
    FragmentD="_",
    FragmentE=planar_angle,
    FragmentF="_",
    FragmentG=member_distance_offset,
    FragmentH="_",
    FragmentI=offset)
division_3 = Division(A=neg_2, B=2)
division_4 = Division(A=subtraction_2, B=2)
max_2 = Maximum(A=division_4, B="-10")
debrep = DeconstructBrep(Brep=non_moving_beam)  # -> Faces, Edges, Vertices
neg_3 = Negative(Value=division_2)
debrep_2 = DeconstructBrep(Brep=non_moving_beam_3)  # -> Faces, Edges, Vertices
panel = Panel(subtraction)
concat_2 = Concatenate(FragmentA=concat, FragmentB="_btm")
concat_3 = Concatenate(FragmentA=concat, FragmentB="_top")
panel_2 = Panel(max_2)
edges = BrepEdges(Brep=debrep_2.Faces)  # -> Naked, Interior, NonManifold
pt = ConstructPoint(XCoordinate=0, YCoordinate=0, ZCoordinate=division_3)
pt_2 = ConstructPoint(XCoordinate=0, YCoordinate=0, ZCoordinate=neg_3)
bcx = BrepCurve(Brep=moving_beam_2, Curve=debrep.Edges)  # -> Curves, Points
sint = SolidIntersection(BrepsA=moving_beam_3, BrepsB=non_moving_beam_3)
xy_2 = XYPlane(Origin=pt)
join = JoinCurves(Curves=edges.Naked, Preserve=False)  # -> flatten(Curves)
panel_3 = Panel(concat_2)
panel_4 = Panel(concat_3)
Z_2 = UnitZ(Factor=panel)
xy_3 = XYPlane(Origin=pt_2)
project = Project(Geometry=join, Plane=xy_2)  # -> Geometry, Transform
move_2 = Move(Geometry=non_moving_beam_2, Motion=Z_2)  # -> Geometry, Transform
sec = BrepPlane(Brep=sint, Plane=xy_2)  # -> Curves, Points
sec_2 = BrepPlane(Brep=sint, Plane=xy_3)  # -> Curves, Points
offset_2 = OffsetCurve(Curve=project.Geometry, Distance=Slider(0.1, range=0..0.1), Plane=PlaneXY(0, 0, 0), Corners=1)  # -> flatten(Curve)
sdiff = SolidDifference(BrepsA=moving_beam, BrepsB=move_2.Geometry)
sdiff_2 = SolidDifference(BrepsA=move_2.Geometry, BrepsB=moving_beam)
createatts = CreateAttributes(Name=panel_3, enableFullPath=False)
createatts_2 = CreateAttributes(Name=panel_4, enableFullPath=False)
rev = Reverse(Vector=Z_2)
runion = RegionUnion(Curves=offset_2, Plane=xy_2)
sdiff_3 = SolidDifference(BrepsA=non_moving_beam_2, BrepsB=sdiff)
move_3 = Move(Geometry=sdiff_2, Motion=rev)  # -> Geometry, Transform
rdiff = RegionDifference(CurvesA=sec.Curves, CurvesB=sec_2.Curves, Plane=xy_2)
rint = RegionIntersection(CurvesA=sec.Curves, CurvesB=sec_2.Curves, Plane=xy_2)
sdiff_4 = SolidDifference(BrepsA=moving_beam, BrepsB=move_3.Geometry)
bake_2 = BakeGeometry(Bake=bake, Geometry=sdiff_4, Attributes=createatts_2, DeleteOldBakes=False, PreserveTrees=False)
rint_2 = RegionIntersection(CurvesA=rint, CurvesB=runion, Plane=xy_2)
number_slider = Slider(10, range=0..10)
geo = Geometry(move_3.Geometry)
bake_3 = BakeGeometry(Bake=bake, Geometry=geo, Attributes=createatts, DeleteOldBakes=False, PreserveTrees=False)
series = Series(Start=5, Step=5, Count=5)
Z_3 = UnitZ(Factor=series)
move_4 = Move(Geometry=sdiff_4, Motion=Z_3)  # -> Geometry, Transform
preview = CustomPreview(Geometry=geo, Material=ColourSwatch(SwatchColor=RGBA(81, 166, 116, 78)))
preview_2 = CustomPreview(Geometry=sdiff_4, Material=ColourSwatch(SwatchColor=RGBA(85, 150, 74, 158)))
sint_2 = SolidIntersection(BrepsA=move_4.Geometry, BrepsB=geo)
sdiff_5 = SolidDifference(BrepsA=geo, BrepsB=sint_2)  # disabled
preview_3 = CustomPreview(Geometry=sint_2, Material=ColourSwatch(SwatchColor=RGB(166, 81, 81)))
