# Grasshopper definition 2_Non Planar Lap Joint Problem.gh (Grasshopper 1.0.7)
# plug-ins: Human

beam_length = Slider(200, range=0..1000)
beam_height = Slider(100, range=0..100)
beam_width_this_is_the_depth_z_axis = Slider(100, range=0..100)
axial_angle = Slider(-10, range=-46..45)
out_of_plane_angle = Slider(-15, range=-46..45)
planar_angle = Slider(57, range=0..100)
member_distance_offset = Slider(40, range=0..100)
offset = Slider(70, range=0..100)
bake = Button()

subtraction = Subtraction(A=50, B=offset)
construct_point = ConstructPoint(XCoordinate=0, YCoordinate=0, ZCoordinate=subtraction)
xy_plane = XYPlane(Origin=construct_point)

subtraction_2 = Subtraction(A=offset, B=100)
neg = Negative(Value=axial_angle)
division = Division(A=beam_height, B=2)
division_2 = Division(A=beam_width_this_is_the_depth_z_axis, B=2)
addition = Addition(A=neg, B=180)
box = CenterBox(Base=PlaneXY(0, 0, 0), X=beam_length, Y=division, Z=division_2)
yz = YZPlane(Origin=Point(0, 0, 0))
xz = XZPlane(Origin=Point(0, 0, 0))
xy = XYPlane(Origin=Point(0, 0, 0))
rotate = Rotate(Geometry=box, Angle=degrees(addition), Plane=yz)  # -> Geometry, Transform
rotate_2 = Rotate(Geometry=rotate.Geometry, Angle=degrees(out_of_plane_angle), Plane=xz)  # -> Geometry, Transform
neg_2 = Negative(Value=member_distance_offset)
rotate_3 = Rotate(Geometry=rotate_2.Geometry, Angle=degrees(planar_angle), Plane=xy)  # -> Geometry, Transform
Z = UnitZ(Factor=neg_2)
move = Move(Geometry=rotate_3.Geometry, Motion=Z)  # -> Geometry, Transform
moving_beam = Geometry(box)
subtraction_3 = Subtraction(A=member_distance_offset, B=beam_width_this_is_the_depth_z_axis)
non_moving_beam = Geometry(move.Geometry)

box_corners = BoxCorners(Box=box)  # -> CornerA, CornerB, CornerC, CornerD, CornerE, CornerF, CornerG, CornerH
line = Line(StartPoint=box_corners.CornerA, EndPoint=box_corners.CornerB)
line_2 = Line(StartPoint=box_corners.CornerC, EndPoint=box_corners.CornerD)

box_corners_2 = BoxCorners(Box=non_moving_beam)  # -> CornerA, CornerB, CornerC, CornerD, CornerE, CornerF, CornerG, CornerH
line_3 = Line(StartPoint=box_corners_2.CornerA, EndPoint=box_corners_2.CornerB)
line_4 = Line(StartPoint=box_corners_2.CornerC, EndPoint=box_corners_2.CornerD)

max = Maximum(B="-10")
concat = Concatenate(
    FragmentA=axial_angle,
    FragmentB="_",
    FragmentC=out_of_plane_angle,
    FragmentD="_",
    FragmentE=planar_angle,
    FragmentF="_",
    FragmentG=member_distance_offset,
    FragmentH="_",
    FragmentI=offset)
division_3 = Division(A=subtraction_3, B=2)
max_2 = Maximum(A=division_3, B="-10")
panel = Panel(subtraction_2)
concat_2 = Concatenate(FragmentA=concat, FragmentB="_btm")
concat_3 = Concatenate(FragmentA=concat, FragmentB="_top")
panel_2 = Panel(max_2)
panel_3 = Panel(concat_2)
panel_4 = Panel(concat_3)
Z_2 = UnitZ(Factor=panel)
plane_3pt = Plane3Pt(PointA=box_corners.CornerA, PointB=box_corners.CornerB, PointC=box_corners.CornerE)
plane_3pt_2 = Plane3Pt(PointA=box_corners.CornerH, PointB=box_corners.CornerG, PointC=box_corners.CornerD)
plane_3pt_3 = Plane3Pt(PointA=box_corners_2.CornerA, PointB=box_corners_2.CornerB, PointC=box_corners_2.CornerE)
plane_3pt_4 = Plane3Pt(PointA=box_corners_2.CornerH, PointB=box_corners_2.CornerG, PointC=box_corners_2.CornerD)
move_2 = Move(Geometry=non_moving_beam, Motion=Z_2)  # -> Geometry, Transform
sdiff = SolidDifference(BrepsA=moving_beam, BrepsB=move_2.Geometry)
sdiff_2 = SolidDifference(BrepsA=move_2.Geometry, BrepsB=moving_beam)
createatts = CreateAttributes(Name=panel_3, enableFullPath=False)
createatts_2 = CreateAttributes(Name=panel_4, enableFullPath=False)
rev = Reverse(Vector=Z_2)
sdiff_3 = SolidDifference(BrepsA=non_moving_beam, BrepsB=sdiff)
move_3 = Move(Geometry=sdiff_2, Motion=rev)  # -> Geometry, Transform
line_plane = LinePlane(Line=line, Plane=plane_3pt_3)  # -> Point, ParamL, ParamP
line_plane_2 = LinePlane(Line=line_2, Plane=plane_3pt_3)  # -> Point, ParamL, ParamP
line_plane_3 = LinePlane(Line=line_3, Plane=plane_3pt)  # -> Point, ParamL, ParamP
line_plane_4 = LinePlane(Line=line_3, Plane=plane_3pt_2)  # -> Point, ParamL, ParamP
sdiff_4 = SolidDifference(BrepsA=moving_beam, BrepsB=move_3.Geometry)  # disabled
bake_2 = BakeGeometry(Bake=bake, Geometry=sdiff_4, Attributes=createatts_2, DeleteOldBakes=False, PreserveTrees=False)
geo = Geometry(move_3.Geometry)  # disabled
bake_3 = BakeGeometry(Bake=bake, Geometry=geo, Attributes=createatts, DeleteOldBakes=False, PreserveTrees=False)
series = Series(Start=5, Step=5, Count=5)
line_plane_5 = LinePlane(Line=line_4, Plane=plane_3pt)  # -> Point, ParamL, ParamP
line_plane_6 = LinePlane(Line=line, Plane=plane_3pt_4)  # -> Point, ParamL, ParamP
line_plane_7 = LinePlane(Line=line_2, Plane=plane_3pt_4)  # -> Point, ParamL, ParamP
line_plane_8 = LinePlane(Line=line_4, Plane=plane_3pt_2)  # -> Point, ParamL, ParamP
Z_3 = UnitZ(Factor=series)
move_4 = Move(Geometry=sdiff_4, Motion=Z_3)  # -> Geometry, Transform
preview = CustomPreview(Geometry=geo, Material=ColourSwatch(SwatchColor=RGBA(161, 90, 19, 78)))
line_5 = Line(StartPoint=line_plane.Point, EndPoint=line_plane_3.Point)
line_6 = Line(StartPoint=line_plane_2.Point, EndPoint=line_plane_4.Point)
sint = SolidIntersection(BrepsA=move_4.Geometry, BrepsB=geo)  # disabled
sdiff_5 = SolidDifference(BrepsA=geo, BrepsB=sint)  # disabled
preview_2 = CustomPreview(Geometry=sdiff_4, Material=ColourSwatch(SwatchColor=RGBA(85, 150, 74, 158)))
plane = Plane(xy_plane)
line_7 = Line(StartPoint=line_plane_6.Point, EndPoint=line_plane_5.Point)
line_8 = Line(StartPoint=line_plane_7.Point, EndPoint=line_plane_8.Point)
preview_3 = CustomPreview(Geometry=sint, Material=ColourSwatch(SwatchColor=RGB(101, 81, 166)))
project = Project(Geometry=line_plane.Point, Plane=plane)  # -> Geometry, Transform
project_2 = Project(Geometry=line_plane_2.Point, Plane=plane)  # -> Geometry, Transform
line_plane_9 = LinePlane(Line=line_5, Plane=plane)  # -> Point, ParamL, ParamP
line_plane_10 = LinePlane(Line=line_6, Plane=plane)  # -> Point, ParamL, ParamP
project_3 = Project(Geometry=line_plane_6.Point, Plane=plane)  # -> Geometry, Transform
project_4 = Project(Geometry=line_plane_7.Point, Plane=plane)  # -> Geometry, Transform
line_plane_11 = LinePlane(Line=line_7, Plane=plane)  # -> Point, ParamL, ParamP
line_plane_12 = LinePlane(Line=line_8, Plane=plane)  # -> Point, ParamL, ParamP
_2_point = Point([line_plane_9.Point, project.Geometry])
ref_point = Point(line_plane_11.Point)
_2_point_2 = Point([project_3.Geometry, line_plane_11.Point])
ref_point_2 = Point(line_plane_9.Point)
_2_point_3 = Point([line_plane_10.Point, project_2.Geometry])
ref_point_3 = Point(line_plane_12.Point)
_2_point_4 = Point([line_plane_12.Point, project_4.Geometry])
ref_point_4 = Point(line_plane_10.Point)
distance = Distance(PointA=_2_point, PointB=ref_point)
distance_2 = Distance(PointA=_2_point_2, PointB=ref_point_2)
distance_3 = Distance(PointA=_2_point_3, PointB=ref_point_3)
distance_4 = Distance(PointA=_2_point_4, PointB=ref_point_4)
sort_list = SortList(Keys=distance, ValuesValuesA=_2_point)  # -> Keys, ValuesValuesA
sort_list_2 = SortList(Keys=distance_2, ValuesValuesA=_2_point_2)  # -> Keys, ValuesValuesA
sort_list_3 = SortList(Keys=distance_3, ValuesValuesA=_2_point_3)  # -> Keys, ValuesValuesA
sort_list_4 = SortList(Keys=distance_4, ValuesValuesA=_2_point_4)  # -> Keys, ValuesValuesA
moving_beam_2 = Geometry(moving_beam)
list_item = ListItem(List=sort_list.ValuesValuesA, Index=0, Wrap=True)
list_item_2 = ListItem(List=sort_list_2.ValuesValuesA, Index=0, Wrap=True)
list_item_3 = ListItem(List=sort_list_3.ValuesValuesA, Index=0, Wrap=True)
list_item_4 = ListItem(List=sort_list_4.ValuesValuesA, Index=0, Wrap=True)
non_moving_beam_2 = Geometry(non_moving_beam)
merge = Merge(Data1=list_item, Data2=list_item_2, Data3=list_item_4, Data4=list_item_3)
merge_2 = Merge(Data1=line_plane.Point, Data2=line_plane_6.Point, Data3=line_plane_7.Point, Data4=line_plane_2.Point)
polyline = PolyLine(Vertices=merge, Closed=True)
polyline_2 = PolyLine(Vertices=merge_2, Closed=True)
loft = Loft(
    Curves=[polyline, polyline_2],
    Options={Adjust=False, Closed=False, LoftEnds=0, LoftSimp=0, LoftType=0, Rebuild=10, Refit=0.01})
cap_holes = CapHoles(Brep=loft)
sdiff_6 = SolidDifference(BrepsA=moving_beam_2, BrepsB=cap_holes)
sdiff_7 = SolidDifference(BrepsA=non_moving_beam_2, BrepsB=sdiff_6)
preview_4 = CustomPreview(Geometry=sdiff_6, Material=ColourSwatch(SwatchColor=RGBA(85, 150, 74, 158)))
preview_5 = CustomPreview(Geometry=sdiff_7, Material=ColourSwatch(SwatchColor=RGBA(161, 90, 19, 78)))

non_moving_beam_3 = Geometry(move.Geometry)
non_moving_beam_4 = Geometry(move.Geometry)
moving_beam_3 = Geometry(box)
moving_beam_4 = Geometry(box)
division_4 = Division(A=neg_2, B=2)
debrep = DeconstructBrep(Brep=non_moving_beam_3)  # -> Faces, Edges, Vertices
neg_3 = Negative(Value=division_2)
debrep_2 = DeconstructBrep(Brep=non_moving_beam_4)  # -> Faces, Edges, Vertices
edges = BrepEdges(Brep=debrep_2.Faces)  # -> Naked, Interior, NonManifold
pt = ConstructPoint(XCoordinate=0, YCoordinate=0, ZCoordinate=division_4)
pt_2 = ConstructPoint(XCoordinate=0, YCoordinate=0, ZCoordinate=neg_3)
bcx = BrepCurve(Brep=moving_beam_3, Curve=debrep.Edges)  # -> Curves, Points
sint_2 = SolidIntersection(BrepsA=moving_beam_4, BrepsB=non_moving_beam_4)
xy_2 = XYPlane(Origin=pt)
join = JoinCurves(Curves=edges.Naked, Preserve=False)  # -> flatten(Curves)
xy_3 = XYPlane(Origin=pt_2)
project_5 = Project(Geometry=join, Plane=xy_2)  # -> Geometry, Transform
sec = BrepPlane(Brep=sint_2, Plane=xy_2)  # -> Curves, Points
sec_2 = BrepPlane(Brep=sint_2, Plane=xy_3)  # -> Curves, Points
offset_2 = OffsetCurve(Curve=project_5.Geometry, Distance=Slider(0.1, range=0..0.1), Plane=PlaneXY(0, 0, 0), Corners=1)  # -> flatten(Curve)
runion = RegionUnion(Curves=offset_2, Plane=xy_2)
rdiff = RegionDifference(CurvesA=sec.Curves, CurvesB=sec_2.Curves, Plane=xy_2)
rint = RegionIntersection(CurvesA=sec.Curves, CurvesB=sec_2.Curves, Plane=xy_2)
rint_2 = RegionIntersection(CurvesA=rint, CurvesB=runion, Plane=xy_2)

brep = Brep(sint_2)
bounding_box = BoundingBox(Content=brep, Plane=PlaneXY(0, 0, 0))  # -> Box, Box_2
curve = Curve([sec.Curves, sec_2.Curves])
deconstruct_box = DeconstructBox(Box=bounding_box.Box)  # -> Plane, X, Y, Z
unit_z = UnitZ(Factor=deconstruct_box.Z)
reverse = Reverse(Vector=unit_z)
extrude = Extrude(Base=rdiff, Direction=reverse)
loft_2 = Loft(Curves=curve, Options={Adjust=False, Closed=False, LoftEnds=0, LoftSimp=0, LoftType=0, Rebuild=10, Refit=0.01})
cap_holes_2 = CapHoles(Brep=extrude)
cap_holes_3 = CapHoles(Brep=loft_2)
solid_intersection = SolidIntersection(BrepsA=cap_holes_3, BrepsB=cap_holes_2)

preview_6 = CustomPreview(Geometry=solid_intersection, Material=ColourSwatch(SwatchColor=RGBA(0, 41, 107, 200)))
