# Grasshopper definition marker_pose_and_calibration.gh (Grasshopper 1.0.7)

# ----
# Marker Calibration from ROS
panel = Panel("192.168.0.120")
panel_2 = Panel("3. Load from ROS")
restart = Button()
ros = PythonScript(ip=panel, restart=restart)  # -> out, ros_client, is_connected
# ---------- ros: Python ----------
import sys
import time
import logging
import scriptcontext as sc

from compas_fab.backends import RosClient

from System import TimeSpan
from System.Threading import ManualResetEventSlim

LOGGER = logging.getLogger('roslibpy')

key = 'rosclient_%s' % str(ghenv.Component.InstanceGuid)
previous_client = sc.sticky.get(key, None)
if previous_client:
    previous_client.terminate()

ros_client = RosClient(ip, 9090)
sc.sticky[key] = ros_client

waitLock = ManualResetEventSlim(False)

ros_client.on_ready(lambda: waitLock.Set())

if not waitLock.Wait(TimeSpan.FromSeconds(5)):
    raise Exception('Unable to connect to ROS')

LOGGER.info('ROS connection opened')


is_connected = ros_client.is_connected
# ---------- end ros ----------
timer = Timer(TimerInterval=50, Target=python)
load = Button()
is_connected = Panel(ros.is_connected)
python = GhPythonScript(y=load)  # -> out, t_camera_from_marker, rhino_plane_cam_from_marker, compas_transform, compas_frame
# ---------- python: Python ----------
from scriptcontext import sticky as st
from compas.geometry import Frame
import Rhino.Geometry as rg

from compas_rhino.geometry import RhinoPoint
from compas_ghpython import draw_points
from compas.geometry import transform_points

print(st['camera_frame'])

if st['camera_frame']:
    T = st['camera_frame']
    t_camera_from_marker = T
    
    
#    compas_transform = T.inverse()
#    compas_frame = Frame.from_transformation(compas_transform)
#    
#    point = list(Frame.from_transformation(compas_t_cam_from_marker).point)
#    xaxis = list(Frame.from_transformation(compas_t_cam_from_marker).xaxis)
#    yaxis = list(Frame.from_transformation(compas_t_cam_from_marker).yaxis)
#    rhino_plane_cam_from_marker = rg.Plane(rg.Point3d(*point), rg.Vector3d(*xaxis), rg.Vector3d(*yaxis))
# ---------- end python ----------
panel_3 = Panel(python.out)

# ----
# Reload Python Modules (if Module Code is Changed)
python_module_to_reload = Panel("""compas
compas_fab
roslibpy
integral_timber_joints""")
# Development Tools
reload = Button()
py = PythonScript(reload_module_button=reload, module_names=python_module_to_reload)  # inputs module_names: list
# ---------- py: Python ----------
import compas_ghpython
from compas_ghpython import unload_modules
if reload_module_button:
    for module in module_names:
        unload_modules(module)
# ---------- end py ----------

# ----
# Check Path and Environment
compas_version = GhPythonScript()  # -> out, compas_version, compas_fab_version, compas_path, compas_fab_path, compas_env_name, python_directory
# ---------- compas_version: Python ----------
__author__ = "leungp"
__version__ = "2020.04.20"

import rhinoscriptsyntax as rs
import compas
import compas_fab
compas_version  = compas.__version__
compas_fab_version = compas_fab.__version__
import os
compas_path = os.path.abspath(compas.__file__)
compas_fab_path = os.path.abspath(compas_fab.__file__)

import compas_bootstrapper
compas_env_name = compas_bootstrapper.ENVIRONMENT_NAME
python_directory = compas_bootstrapper.PYTHON_DIRECTORY
# ---------- end compas_version ----------
compas_environment_name = Panel(compas_version.compas_env_name)
compas_version_2 = Panel(compas_version.compas_version)
compas_fab_version = Panel(compas_version.compas_fab_version)
compas_path = Panel(compas_version.compas_path)
compas_fab_path = Panel(compas_version.compas_fab_path)
python_directory = Panel(compas_version.python_directory)

# ---- group: Setup Callback for Topic
load_2 = Button()
python_2 = PythonScript(client=ros.ros_client, load=load_2, ros_topic_name="/camera_frame")  # -> robot; inputs load: Boolean
# ---------- python_2: Python ----------
from scriptcontext import sticky as st
import json
import compas
from compas.robots import RobotModel
from compas.geometry import Transformation
from compas_fab.backends import RosClient
from compas_fab.backends import RosFileServerLoader
from compas_fab.ghpython import RobotArtist
from roslibpy import Topic
# Set high precision to import meshes defined in meters
compas.PRECISION = '24f'

# store robot in component
guid = str(ghenv.Component.InstanceGuid)
topic_key = "topic_" + guid

if topic_key not in st:
    st[topic_key] = None

if client and client.is_connected and load:
    st['camera_frame'] = None
    def read_frame(msg):
        st['camera_frame'] = Transformation.from_data(json.loads(msg['data']))
        
    topic = Topic(client, ros_topic_name, 'std_msgs/String')
    topic.subscribe(read_frame)
    st[topic_key] = topic

topic = st[topic_key]
# ---------- end python_2 ----------

# ----
# Marker Position from CAD
# Flange Frame
# Marker Frame
frame_curves_named_x_and_y = Curve([<curve referenced from the Rhino model> x3])
frame_curves_named_x_and_y_2 = Curve([<curve referenced from the Rhino model> x3])
frame_from_crv = FrameFromCrv(frame_curves_named_x_and_y=frame_curves_named_x_and_y)
frame_from_crv_2 = FrameFromCrv(frame_curves_named_x_and_y=frame_curves_named_x_and_y_2)
flange_frame = Plane(frame_from_crv)
marker_frame = Plane(frame_from_crv_2)
python_3 = GhPythonScript(flange_frame=flange_frame, marker_frame=marker_frame)  # -> out, t_flange_from_marker
# ---------- python_3: Python ----------
#from compas_ghpython import unload_modules
#unload_modules("integral_timber_joints")

from compas.geometry import Frame, Vector, Transformation
from compas_rhino.geometry import RhinoPlane, RhinoMesh, RhinoVector, RhinoLine

flange_frame = RhinoPlane.from_geometry(flange_frame).to_compas()
marker_frame = RhinoPlane.from_geometry(marker_frame).to_compas()
t_world_from_flange = Transformation.from_frame(flange_frame)
t_world_from_marker = Transformation.from_frame(marker_frame)
t_flange_from_marker = t_world_from_flange.inverse() * t_world_from_marker
print (t_flange_from_marker)
# ---------- end python_3 ----------
panel_4 = Panel(python_3.out)

# ----
# Click to grab frame for calibration
dam = DataDam(DataA=python.t_camera_from_marker, BufferDelay=10000000, BufferMode=0)

# ----
# Save Calibration
panel_5 = Panel("C:\Users\leungp\Documents\GitHub\clamp_controller\calibrations\")
concat = Concatenate(FragmentA=panel_5, FragmentB="cam100_t_flange_from_marker.json")
concat_2 = Concatenate(FragmentA=panel_5, FragmentB="cam100_t_camera_from_marker.json")
python_4 = GhPythonScript(T=python_3.t_flange_from_marker, filename=concat, save=Button())  # -> out, a
# ---------- python_4: Python ----------
from compas.data import DataEncoder
import json
if save:
    with open(filename, 'w') as f:
        json.dump(T, f, cls=DataEncoder, indent=4, sort_keys=True)
# ---------- end python_4 ----------
python_5 = GhPythonScript(T=dam, filename=concat_2, save=Button())  # -> out, a; same code as python_4

# ----
# Validate camera frame
python_6 = GhPythonScript(t_flange_from_marker=python_3.t_flange_from_marker, t_camera_from_marker=dam)  # -> out, t_flange_from_camera, p_flange_from_camera
# ---------- python_6: Python ----------
from compas.geometry import Frame
import Rhino.Geometry as rg
import rhinoscriptsyntax as rs

t_flange_from_camera = t_flange_from_marker * t_camera_from_marker.inverse()
#    compas_frame = Frame.from_transformation(compas_transform)
#    
point = list(Frame.from_transformation(t_flange_from_camera).point)
xaxis = list(Frame.from_transformation(t_flange_from_camera).xaxis)
yaxis = list(Frame.from_transformation(t_flange_from_camera).yaxis)
p_flange_from_camera = rg.Plane(rg.Point3d(*point), rg.Vector3d(*xaxis), rg.Vector3d(*yaxis))
# ---------- end python_6 ----------
orient = Orient(Geometry=python_6.p_flange_from_camera, Source=PlaneXY(0, 0, 0), Target=flange_frame)  # -> Geometry, Transform

# ----
# Correction calculation test
python_7 = GhPythonScript(
    t_flange_from_marker=python_3.t_flange_from_marker,
    t_camera_from_marker=dam,
    t_camera_from_observedmarker=python.t_camera_from_marker)  # -> out, t_flange_from_newflange, p_flange_from_newflange
# ---------- python_7: Python ----------
from compas.geometry import Frame
import Rhino.Geometry as rg
import rhinoscriptsyntax as rs

# From CAD
t_flange_from_marker = t_flange_from_marker

# From Marker Calibration
t_camera_from_marker = t_camera_from_marker

# Observation: Observed Marker in Camera Frame
t_camera_from_observedmarker = t_camera_from_observedmarker

# Calcualtion: Camera in Flange Frame
t_flange_from_camera = t_flange_from_marker * t_camera_from_marker.inverse()

# Calculation: New Flange Frame in current flange frame 
t_observedmarker_from_newflange = t_flange_from_marker.inverse()
t_flange_from_newflange = t_flange_from_camera * t_camera_from_observedmarker * t_observedmarker_from_newflange

print(t_flange_from_newflange)

T = t_flange_from_newflange
point = list(Frame.from_transformation(T).point)
xaxis = list(Frame.from_transformation(T).xaxis)
yaxis = list(Frame.from_transformation(T).yaxis)
p_flange_from_newflange = rg.Plane(rg.Point3d(*point), rg.Vector3d(*xaxis), rg.Vector3d(*yaxis))
# ---------- end python_7 ----------
panel_6 = Panel(python_7.out)
panel_7 = Panel(python_7.p_flange_from_newflange)
orient_2 = Orient(Geometry=python_7.p_flange_from_newflange, Source=PlaneXY(0, 0, 0), Target=flange_frame)  # -> Geometry, Transform

# ==== cluster FrameFromCrv
frame_curves_named_x_and_y = ClusterInput()
frame_curves_named_x_and_y_2 = Curve(frame_curves_named_x_and_y)
filtername = FilterByName(Geometry=frame_curves_named_x_and_y_2, Name="y")
filtername_2 = FilterByName(Geometry=frame_curves_named_x_and_y_2, Name="x")
end = EndPoints(Curve=filtername_2)  # -> Start, End
end_2 = EndPoints(Curve=filtername)  # -> Start, End
pl_3pt = Plane3Pt(PointA=end.Start, PointB=end.End, PointC=end_2.End)
pl = ClusterOutput(pl_3pt)
