# Grasshopper definition robot_urdf_visualize.gh (Grasshopper 1.0.7)

panel = Panel("C:\Users\leungp\Documents\GitHub\integral_timber_joints\external\compas_fab_pychoreo\data\robots")
panel_2 = Panel("C:\Users\leungp\Documents\GitHub\temp_abb_urdf")
frame_curves_named_x_and_y = Curve([<curve referenced from the Rhino model> x3])
a1 = Slider(0, range=-360..360)
a2 = Slider(0, range=-360..360)
a3 = Slider(-179, range=-360..360)
a4 = Slider(0, range=-360..360)
a5 = Slider(0, range=-120..120)
a6 = Slider(0, range=-360..360)
gantry_x = Slider(0, range=0..26000)
gantry_y = Slider(0, range=-17001..0)
gantry_z = Slider(-3000, range=-4700..500)
a2_2 = Slider(-52, range=-360..360)
a4_2 = Slider(-8, range=-360..360)
a5_2 = Slider(41, range=-360..360)
a1_2 = Slider(38, range=-360..360)
a3_2 = Slider(4, range=-360..360)
a6_2 = Slider(0, range=-360..360)
gantry_y_2 = Slider(-9281, range=-17001..0)
gantry_z_2 = Slider(-4700, range=-4700..500)
frame_from_crv = FrameFromCrv(frame_curves_named_x_and_y=frame_curves_named_x_and_y)
geo = Geometry([<brep referenced from the Rhino model> x2])
geo_2 = Geometry(<brep referenced from the Rhino model>)
geo_3 = Geometry(<mesh referenced from the Rhino model>)
merge = Merge(Data1=gantry_x, Data2=gantry_y, Data3=gantry_z, Data4=a1, Data5=a2, Data6=a3, Data7=a4, Data8=a5, Data9=a6)
merge_2 = Merge(Data1=gantry_y_2, Data2=gantry_z_2, Data3=a1_2, Data4=a2_2, Data5=a3_2, Data6=a4_2, Data7=a5_2, Data8=a6_2)
merge_3 = Merge(Data1=geo, Data2=geo_3)
pln = Plane(frame_from_crv)

# ----
# Robot
load = Button()
ghpython_script = PythonScript(
    load=load,
    pkg_path="C:\Users\leungp\Documents\GitHub",
    pkg_name="rfl_description",
    urdf_file="rfl.urdf",
    srdf_file="rfl.srdf")  # -> out, robot
# ---------- ghpython_script: Python ----------
from scriptcontext import sticky as st
import os
import compas

from compas.robots import RobotModel
from compas.robots import GithubPackageMeshLoader
from compas.robots import LocalPackageMeshLoader
from compas_fab.robots import Robot
from compas_fab.robots import RobotSemantics
from compas_ghpython.artists import RobotModelArtist

# Robot meshes are usually in meters
# Set a high percision to prevent parsing errors
# and configure Rhino itself in meters
compas.PRECISION = '12f'

# Store robot in component-based key
robot_key = 'robot_{}'.format(str(ghenv.Component.InstanceGuid))

if robot_key not in st:
    st[robot_key] = None

if load:
    # Also load geometry
    loader = LocalPackageMeshLoader(os.path.join(pkg_path, 'rfl_description'), pkg_name)
    abb_loader = LocalPackageMeshLoader(os.path.join(pkg_path), "abb_irb4600_40_255")
    
    # Create robot model from URDF
    model = RobotModel.from_urdf_string(loader.load_urdf(urdf_file).read())
    model.load_geometry(loader, abb_loader)

    artist = RobotModelArtist(model)
    
    robot_semantics = None
    if srdf_file:
        robot_semantics = RobotSemantics.from_srdf_file(loader.build_path('urdf', srdf_file), model)
    
    robot = Robot(model, artist, semantics=robot_semantics)
#    robot.scale(1000)
    st[robot_key] = robot

robot = st[robot_key]

#repo    = 'ros-industrial/abb'
#package = 'abb_irb6600_support'
#branch  = 'kinetic-devel'
#
#github = GithubPackageMeshLoader(repo, package, branch)
#
#model = RobotModel.from_urdf_file(github.load_urdf('irb6640.urdf'))
#model.load_geometry(github)
#artist = RobotModelArtist(model)
#robot = Robot(model, artist)
# ---------- end ghpython_script ----------
robot = Data(ghpython_script.robot)

python_script = PythonScript(robot11=merge, robot12=merge_2)  # -> out, c; inputs robot11: list, robot12: list
# ---------- python_script: Python ----------
from compas_fab.robots import Configuration
from math import radians as rad

print robot11
print robot12

start_full_configuration = Configuration(
    values = (
        robot11[0],
        robot11[1], robot11[2],
        rad(robot11[3]), rad(robot11[4]), rad(robot11[5]), rad(robot11[6]), rad(robot11[7]), rad(robot11[8]),
        robot12[0], robot12[1],
        rad(robot12[2]), rad(robot12[3]), rad(robot12[4]), rad(robot12[5]), rad(robot12[6]), rad(robot12[7]),
        38000,
        0, -4915,
        0, 0, 0, 0, 0, 0,
        -12237, -4915,
        0, 0, 0, 0, 0, 0
        ),
    types = (
        2,
        2, 2,
        0, 0, 0, 0, 0, 0,
        2, 2,
        0, 0, 0, 0, 0, 0,
        2,
        2, 2,
        0, 0, 0, 0, 0, 0,
        2, 2,
        0, 0, 0, 0, 0, 0
        ),
    joint_names = (
        'bridge1_joint_EA_X',
        'robot11_joint_EA_Y', 'robot11_joint_EA_Z',
        'robot11_joint_1', 'robot11_joint_2', 'robot11_joint_3', 'robot11_joint_4', 'robot11_joint_5', 'robot11_joint_6',
        'robot12_joint_EA_Y', 'robot12_joint_EA_Z',
        'robot12_joint_1', 'robot12_joint_2', 'robot12_joint_3', 'robot12_joint_4', 'robot12_joint_5', 'robot12_joint_6',
        'bridge2_joint_EA_X',
        'robot21_joint_EA_Y', 'robot21_joint_EA_Z',
        'robot21_joint_1', 'robot21_joint_2', 'robot21_joint_3', 'robot21_joint_4', 'robot21_joint_5', 'robot21_joint_6',
        'robot22_joint_EA_Y', 'robot22_joint_EA_Z',
        'robot22_joint_1', 'robot22_joint_2', 'robot22_joint_3', 'robot22_joint_4', 'robot22_joint_5', 'robot22_joint_6'
        )
    )

c = start_full_configuration.scaled(1e-3)
# ---------- end python_script ----------
# floor mount
configurations_at_pickup = Data(python_script.c)
panel_3 = Panel(ghpython_script.out)
# Visualisation
panel_4 = Panel("manipulator_gripper")
show_end_effector_frame = BooleanToggle(True)
show_base_frame = BooleanToggle(True)
show_visual = BooleanToggle(True)
show_collision = BooleanToggle(True)
show_frames = BooleanToggle(True)
visualize = PythonScript(
    robot=robot,
    group="robot11_eaXYZ",
    configuration=configurations_at_pickup,
    show_visual=show_visual,
    show_collision=show_collision,
    show_frames=show_frames,
    show_base_frame=show_base_frame,
    show_end_effector_frame=show_end_effector_frame)  # -> out, visual, collision, frames, ee_frame, base_frame
# ---------- visualize: Python ----------
"""Visualizes a robot.
    Inputs:
        robot: The robot
        configuration: :class:`compas_fab.robots.Configuration`
            The robot's full configuration to display.
        show_visual: bool
           Whether or not to show the robot's visual meshes.
        show_collision: bool
           Whether or not to show the robot's collision meshes.
        show_frames: bool
           Whether or not to show the robot's joint frames.
        show_base_frame: bool
           Whether or not to show the robot's base frame.
        show_end_effector_frame: bool
            Whether or not to show the robot's end-effector frame.
    Output:
        visual: The robot's visual meshes.
        collision: The robot's collision meshes.
        frames: The robot's joint frames.
        base_frame: The robot's base frame.
        ee_frame: The robot's end-effector frame.
"""
from __future__ import print_function
print (robot.group_names)
if robot and configuration:
    group = group or None
    robot.update(configuration, group, visual=show_visual, collision=show_collision)
    print(robot.get_end_effector_link_name(group))
    
    if show_visual:
        visual = robot.artist.draw_visual()

    if show_collision:
        collision = robot.artist.draw_collision()

    if show_frames:
        axes = robot.transformed_axes(configuration, group)
        frames = robot.transformed_frames(configuration, group)

    if show_base_frame:
        frames = robot.transformed_frames(configuration, group)
        base_frame = frames[0]

    if show_end_effector_frame:
        ee_frame = robot.forward_kinematics(configuration, group)
        print("End-effector", ee_frame)
# ---------- end visualize ----------
python = GhPythonScript(frame=visualize.ee_frame)  # -> out, plane
# ---------- python: Python ----------
from compas_ghpython import draw_frame
plane = draw_frame(frame)
# ---------- end python ----------
draw = GhPythonScript(frames=[visualize.frames, visualize.ee_frame, visualize.base_frame], scale=Slider(1, range=0..1))  # -> P, V, C, W, flatten(planes); inputs frames: list
# ---------- draw: Python ----------
from System.Drawing import Color
from compas_ghpython import draw_frame

red = Color.FromArgb(255, 0, 0)
green = Color.FromArgb(0, 255, 0)
blue = Color.FromArgb(0, 0, 255)

P = []
V = []
C = []
planes = []

scale = float(scale)

for frame in frames:
    if not frame:
        continue
    plane = draw_frame(frame)
    P += [plane.Origin] * 3
    V.append(plane.XAxis * scale)
    V.append(plane.YAxis * scale)
    V.append(plane.ZAxis * scale)
    C += [red, green, blue]
    planes.append(plane)

W = 3
# ---------- end draw ----------
geometry = Geometry(visualize.collision)
geometry_2 = Geometry(visualize.visual)
scale = Scale(Geometry=draw.P, Center=Point(0, 0, 0), Factor=1000)  # -> Geometry, Transform
scale_2 = Scale(Geometry=python.plane, Center=Point(0, 0, 0), Factor=1000)  # -> Geometry, Transform
orient = Orient(Geometry=geo_2, Source=pln, Target=scale_2.Geometry)  # -> Geometry, Transform
orient_2 = Orient(Geometry=merge_3, Source=pln, Target=scale_2.Geometry)  # -> Geometry, Transform
scale_3 = Scale(Geometry=geometry_2, Center=Point(0, 0, 0), Factor=1000)  # -> Geometry, Transform
scale_4 = Scale(Geometry=geometry, Center=Point(0, 0, 0), Factor=1000)  # -> Geometry, Transform
colom = CollisionOneMany(Collider=orient.Geometry, Obstacles=scale_4.Geometry)  # -> Collision, Index
item = ListItem(
    List=[ColourSwatch(SwatchColor=RGBA(76, 161, 55, 139)), ColourSwatch(SwatchColor=RGB(161, 55, 55))],
    Index=colom.Collision,
    Wrap=True)
preview = CustomPreview(Geometry=orient.Geometry, Material=item)
vector_display_ex = VectorDisplayEx(Point=scale.Geometry, Vector=draw.V, Colour=draw.C, Width=draw.W)
panel_5 = Panel(scale_2.Geometry)
preview_2 = CustomPreview(Geometry=scale_3.Geometry, Material=ColourSwatch(SwatchColor=RGBA(50, 119, 168, 137)))
preview_3 = CustomPreview(Geometry=scale_4.Geometry, Material=ColourSwatch(SwatchColor=RGBA(176, 99, 99, 42)))

# ==== cluster FrameFromCrv
frame_curves_named_x_and_y = ClusterInput()
frame_curves_named_x_and_y_2 = Curve(frame_curves_named_x_and_y)
filtername = FilterByName(Geometry=frame_curves_named_x_and_y_2, Name="y")
filtername_2 = FilterByName(Geometry=frame_curves_named_x_and_y_2, Name="x")
end = EndPoints(Curve=filtername_2)  # -> Start, End
end_2 = EndPoints(Curve=filtername)  # -> Start, End
pl_3pt = Plane3Pt(PointA=end.Start, PointB=end.End, PointC=end_2.End)
pl = ClusterOutput(pl_3pt)
